# Grasshopper definition Inverse_Prediction.gh (Grasshopper 1.0.8)
# plug-ins: CORE.Toolbox.Grasshopper, Heteroptera, MeshEdit Components, Pufferfish, Anemone, PTComponentLibrary, LunchBox, Flexibility

crv = Curve(<curve referenced from the Rhino model>)  # disabled
crv_2 = Curve(<curve referenced from the Rhino model>)  # disabled
crv_3 = Curve(<curve referenced from the Rhino model>)  # disabled
loft = Loft(
    Curves=[crv, crv_2, crv_3],
    Options={Adjust=False, Closed=False, LoftEnds=0, LoftSimp=0, LoftType=0, Rebuild=10, Refit=0.01})  # disabled

# ----
# Testing Model Results  - Inverse
# 1. Set Surface
srf = Surface(<surface referenced from the Rhino model>)
flipdirection = FlipDirection(Surface=srf, Direction=Slider(0, range=0..5), Flip=Toggle(False), Density=5)

# ---- group: This is to shorten optimization time
number_slider = Slider(3, range=0..10)
number_slider_2 = Slider(5, range=0..10)
rebsrf = RebuildSurface(Surface=flipdirection, CountU=number_slider_2, CountV=number_slider_2, DegreeU=number_slider, DegreeV=number_slider)

# ---- group: Approximate Developable Surface
pow = Power(A=Slider(0.1, range=0..0.1), B=Slider(8, range=0..10))
developable_surface_optimization = Python3Script(
    surface_id=rebsrf,
    n_of_u_samples=Slider(12, range=0..100),
    n_of_v_samples=Slider(12, range=0..100),
    max_iterations=Slider(200, range=0..1000),
    ftol=pow)  # -> out, nurbs_surface, iterations, average_distance; inputs surface_id: Surface, n_of_u_samples: Int32, n_of_v_samples: Int32, max_iterations: Int32; disabled
# ---------- developable_surface_optimization: Python ----------
# venv: developable_surface_optimization
# requirements: scipy, numpy

import Rhino
import scipy
import numpy as np
from scipy.optimize import minimize

# Compute Gaussian curvature at surface UV points
def gaussian_curvature(surface, u, v):
    srf = surface.ToNurbsSurface()
    props = srf.CurvatureAt(u, v)
    return props.Gaussian

# Objective function minimizing max(gc^2) + sum(gc^2)
def objective(ctrl_pts_flat, surface, u_samples, v_samples, nurbs_surface, initial_ctrl_pts):
    num_pts_u, num_pts_v, _ = nurbs_surface.Points.CountU, nurbs_surface.Points.CountV, 3
    ctrl_pts = ctrl_pts_flat.reshape((num_pts_u, num_pts_v, 3))

    # Update control points
    for i in range(num_pts_u):
        for j in range(num_pts_v):
            nurbs_surface.Points.SetControlPoint(i, j, Rhino.Geometry.ControlPoint(Rhino.Geometry.Point3d(*ctrl_pts[i, j])))

    curvatures = []
    for u in u_samples:
        for v in v_samples:
            gc = gaussian_curvature(nurbs_surface, u, v)
            curvatures.append(abs(gc))

    max_gc2 = max(curvatures)
    sum_gc2 = sum(curvatures)
    total = max_gc2 + sum_gc2

    print(f"Current total curvature: {total} (max: {max_gc2}, sum: {sum_gc2})")
    return total

# Main function to approximate a Rhino surface with developable surface
def approximate_developable(surface):
    print("Starting approximation...")
    nurbs_surface = surface.ToNurbsSurface()

    u_samples = np.linspace(nurbs_surface.Domain(0)[0], nurbs_surface.Domain(0)[1], n_of_u_samples)
    v_samples = np.linspace(nurbs_surface.Domain(1)[0], nurbs_surface.Domain(1)[1], n_of_v_samples)

    print("Sampling domains:", u_samples, v_samples)

    # Initial control points
    num_pts_u, num_pts_v = nurbs_surface.Points.CountU, nurbs_surface.Points.CountV
    ctrl_pts = np.array([[[pt.Location.X, pt.Location.Y, pt.Location.Z] for pt in [nurbs_surface.Points.GetControlPoint(i, j) for j in range(num_pts_v)]] for i in range(num_pts_u)])

    print("Initial control points retrieved")

    # Flatten control points array for optimizer
    ctrl_pts_flat = ctrl_pts.flatten()

    # Run optimization
    print("Starting optimization...")
    result = minimize(objective, ctrl_pts_flat, args=(surface, u_samples, v_samples, nurbs_surface, ctrl_pts), method='L-BFGS-B', options={'maxiter': max_iterations, 'ftol': ftol})

    print("Optimization finished")
    print(f"Optimization success: {result.success}, message: {result.message}")
    print(f"Total iterations performed: {result.nit}")
    iterations = result.nit

    # Update NURBS with optimized control points
    optimized_ctrl_pts = result.x.reshape((num_pts_u, num_pts_v, 3))
    for i in range(num_pts_u):
        for j in range(num_pts_v):
            nurbs_surface.Points.SetControlPoint(i, j, Rhino.Geometry.ControlPoint(Rhino.Geometry.Point3d(*optimized_ctrl_pts[i, j])))

    print("Control points updated with optimized values")

    # Duplicate surface to ensure updated geometry is returned
    new_surface = nurbs_surface.Duplicate()

    # Compute average distance moved by control points
    distances = np.linalg.norm(optimized_ctrl_pts - ctrl_pts, axis=2)
    average_distance = np.mean(distances)
    print(f"Average control point movement: {average_distance}")

    return nurbs_surface, iterations, average_distance

# Example usage
if surface_id:
    print(surface_id)
    nurbs_surface, iterations, average_distance = approximate_developable(surface_id)
# ---------- end developable_surface_optimization ----------
iterations = Panel(developable_surface_optimization.iterations)

# ---- group: Srr curvature
number_slider_3 = Slider(10, range=0..10)  # disabled
sdivide = DivideSurface(Surface=developable_surface_optimization.nurbs_surface, UCount=10, VCount=10)  # -> Points, Normals, Parameters; disabled
curvature = SurfaceCurvature(Surface=developable_surface_optimization.nurbs_surface, Point=sdivide.Parameters)  # -> Frame, Gaussian, Mean; disabled
tag = TextTag(Location=sdivide.Points, Text=curvature.Gaussian)  # disabled

# ----
panel = Panel(developable_surface_optimization.out)
srf_2 = Surface(rebsrf)

# ---- group: How different is it
sdivide_2 = DivideSurface(Surface=rebsrf, UCount=10, VCount=10)  # -> Points, Normals, Parameters
sdivide_3 = DivideSurface(Surface=srf_2, UCount=10, VCount=10)  # -> Points, Normals, Parameters
dist = Distance(PointA=sdivide_2.Points, PointB=sdivide_3.Points)
avr = Average(Input=flatten(dist))
panel_2 = Panel(avr)

# ---- group: Orient Surface to XY plane
number_slider_4 = Slider(5, range=0..10)
divide_surface = DivideSurface(Surface=srf_2, UCount=number_slider_4, VCount=number_slider_4)  # -> Points, Normals, Parameters
area = Area(Geometry=srf_2)  # -> Area, Centroid
evalsrf = EvaluateSurface(Surface=srf_2, Point=divide_surface.Parameters)  # -> Point, Normal, UDirection, VDirection, Frame
average_plane = AveragePlane(Planes=flatten(evalsrf.Frame))
xy = XYPlane(Origin=Point(0, 0, 0))
orient = Orient(Geometry=srf_2, Source=area.Centroid, Target=xy)  # -> Geometry, Transform

# ---- group: Get Curvature / Test
dim = Dimensions(Surface=orient.Geometry)  # -> UDimension, VDimension
rebuildsrf = RebuildSurface(Surface=orient.Geometry, UDegree=3, VDegree=3, UNumber=dim.UDimension, VNumber=dim.VDimension)

# ---- group: Get Curvature / Move if needed
Y = UnitY(Factor=Slider(0, range=-100..100))
move = Move(Geometry=orient.Geometry, Motion=Y)  # -> Geometry, Transform

# ----
preview = CustomPreview(Material={diffuse=RGB(221, 160, 221), emission=RGB(66, 48, 66), shine=0.5, specular=RGB(255, 255, 255), transparency=0})
swatch = ColourSwatch(SwatchColor=RGB(255, 180, 130))  # disabled
number_slider_5 = Slider(1.3, range=0.1..2)  # disabled

# ---- group: Inputs
model_path_lab_pc = Panel("C:\Gal_Msc\Ipublic-repo\inverse-model-frustrated-composites\saved_models\legendary-sun-inverse.pkl")
number_slider_6 = Slider(8, range=0..10)
patch_size = Slider(10, range=0..10)
path = FilePath(model_path_lab_pc)

# ---- group: Inputs / Should match training set
number_slider_7 = Slider(5, range=0..20)
number_slider_8 = Slider(1, range=0..2)
smoothing_method = Panel("uniform")

# ---- group: Inputs / Normalization Values - should match training
# 2. Define Inputs
max_smooth = Panel("""0.25
0.25
0.25
0.25
0.25
0.25
0.25
0.25""")
min_smooth = Panel("""-0.25
-0.25
-0.25
-0.25
-0.25
-0.25
-0.25
-0.25""")

# ---- group: Get Average Per Patch / bigger = more weight to the center of the patch
w = Slider(5, range=0.1..50)

# ----
swatch_2 = ColourSwatch(SwatchColor=RGB(0, 0, 0))

# ---- group: Calculate weighed chamfer distance / Concentric Weights / weight differences
number_slider_9 = Slider(1, range=0..1)  # disabled
number_slider_10 = Slider(0.3, range=0..1)  # disabled

# ----
data = Data([1, 1, 1, 1, 1, 1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])  # disabled
smooth = Smooth(Strength=1)

subtraction = Subtraction(B=0.5)
subtraction_2 = Subtraction(B=0.5)
vec = VectorXYZ(XComponent=Slider(0.3, range=-1..1), YComponent=Slider(-0.4, range=-1..1), ZComponent=0)  # -> Vector, Length
number_slider_11 = Slider(20, range=1..100)
number_slider_12 = Slider(1, range=0..1)
swatch_3 = ColourSwatch(SwatchColor=RGB(18, 19, 46))
number_slider_13 = Slider(4.02, range=0..5)
curvepreview = CurvePreview(Curve=srf, Width=number_slider_13, Color=swatch_3, Mode=0, TopMost=False)

# ---- group: Heydat / Heydar Aliev
srf_3 = Surface(<surface referenced from the Rhino model>)  # disabled
number_slider_14 = Slider(7, range=0..100)  # disabled
number_slider_15 = Slider(2, range=0..100)  # disabled
dim_2 = Dimensions(Surface=srf_3)  # -> UDimension, VDimension; disabled
panel_3 = Panel([dim_2.UDimension, dim_2.VDimension])  # disabled
divide = DivideDomain²(Domain=srf_3, UCount=number_slider_15, VCount=number_slider_14)  # disabled
number_slider_16 = Slider(0, range=0..100)  # disabled
subsrf = Isotrim(Surface=srf_3, Domain=divide)  # disabled

# ---- group: Loop
button = Button()  # disabled
lng = ListLength(List=subsrf)  # disabled
loop_start = LoopStart(Repeat=lng, Trigger=button)  # -> port, Counter, Data; disabled
rec = DataRecorder(loop_start.Counter, DataLimit=-10, RecordData=True)  # disabled
panel_4 = Panel(rec)  # disabled

# ----
loop_count = Integer(loop_start.Counter)  # disabled

# ---- group: Heydat / Heydar Aliev (continued)
item = ListItem(List=subsrf, Index=loop_count, Wrap=True)  # disabled
dim_3 = Dimensions(Surface=item)  # -> UDimension, VDimension; disabled
panel_5 = Panel([dim_3.UDimension, dim_3.VDimension])  # disabled

# ----
move_2 = Move(Geometry=item, Motion=vec.Vector)  # -> Geometry, Transform
crv_4 = Curve(move_2.Geometry)
crv_5 = Curve(subsrf)
preview_2 = CustomPreview(Geometry=move_2.Geometry, Material=ColourSwatch(SwatchColor=RGBA(108, 174, 212, 110)))
curvepreview_2 = CurvePreview(Curve=crv_4, Width=Slider(10, range=0..10), Color=swatch_3, Mode=0, TopMost=False)
curvepreview_3 = CurvePreview(Curve=crv_5, Width=number_slider_13, Color=ColourSwatch(SwatchColor=RGB(0, 0, 0)), Mode=0, TopMost=False)

# ---- group: Heydat / Bring to World
sframes = SurfaceFrames(Surface=item, UCount=10, VCount=10)  # -> Frames, flatten(Parameters); disabled
evalsrf_2 = EvaluateSurface(Surface=item, Point=sframes.Parameters)  # -> Point, Normal, UDirection, VDirection, Frame; disabled
avrpln = AveragePlane(Planes=flatten(evalsrf_2.Frame))  # disabled
xy_2 = XYPlane(Origin=Point(0, 0, 0))  # disabled
orient_2 = Orient(Geometry=item, Source=avrpln, Target=xy_2)  # -> Geometry, Transform; disabled

# ---- group: Heydat / Rotate if Convex
sframes_2 = SurfaceFrames(Surface=orient_2.Geometry, UCount=10, VCount=10)  # -> Frames, flatten(Parameters); disabled
evalsrf_3 = EvaluateSurface(Surface=orient_2.Geometry, Point=sframes_2.Parameters)  # -> Point, Normal, UDirection, VDirection, Frame; disabled
number_slider_17 = Slider(0, range=0..100)  # disabled
curvature_2 = SurfaceCurvature(Surface=orient_2.Geometry, Point=sframes_2.Parameters)  # -> Frame, Gaussian, Mean; disabled
devec = DeconstructVector(Vector=evalsrf_3.Normal)  # -> XComponent, YComponent, ZComponent; disabled
avr_2 = Average(Input=curvature_2.Mean)  # disabled
avr_3 = Average(Input=devec.ZComponent)  # disabled
vdisex = VectorDisplayEx(Point=evalsrf_3.Point, Vector=evalsrf_3.Normal, Colour=RGB(0, 0, 0), Width=2)  # disabled
smaller = SmallerThan(FirstNumber=avr_3, SecondNumber=number_slider_17)  # -> SmallerThan, OrEqualTo; disabled
smaller_2 = SmallerThan(FirstNumber=avr_2, SecondNumber=number_slider_17)  # -> SmallerThan, OrEqualTo; disabled
panel_6 = Panel(smaller_2.SmallerThan)  # disabled
panel_7 = Panel(smaller.SmallerThan)  # disabled
addition = Addition(A=smaller.SmallerThan, B=smaller_2.SmallerThan)  # disabled
panel_8 = Panel("0")  # disabled
panel_9 = Panel("Pi")  # disabled
panel_10 = Panel("0")  # disabled
filter = StreamFilter(Gate=addition, Stream0=panel_10, Stream1=panel_9, Stream2=panel_8)  # disabled
xz = XZPlane(Origin=Point(0, 0, 0))  # disabled
rotate = Rotate(Geometry=orient_2.Geometry, Angle=filter, Plane=xz)  # -> Geometry, Transform; disabled

# ---- group: Heydat
merge = Merge(Data1=orient_2.Transform, Data2=rotate.Transform)  # disabled
mtran = MassTransform(Transforms=merge)  # -> MassTransform, PartialTransforms; disabled
inverse = InverseTransform(Transform=mtran.MassTransform)  # disabled

# ---- group: Heydat / Loop
toggle = BooleanToggle(True)  # disabled
toggle_2 = BooleanToggle(False)  # disabled

# ---- group: Visualize Vectors
number_slider_18 = Slider(16, range=0..100)

# ----
number_slider_19 = Slider(14, range=0..100)  # disabled
swatch_4 = ColourSwatch(SwatchColor=RGB(186, 84, 0))  # disabled

# ---- group: Get Curvature
dim_4 = Dimensions(Surface=rebuildsrf)  # -> UDimension, VDimension
roundf = RoundToFactor(NumberX=dim_4.VDimension, Factor=patch_size, RoundType=0)  # -> Rounded, Difference, MultiplierR, MultiplierX
roundf_2 = RoundToFactor(NumberX=dim_4.UDimension, Factor=patch_size, RoundType=0)  # -> Rounded, Difference, MultiplierR, MultiplierX
panel_11 = Panel(roundf_2.Rounded)
panel_12 = Panel(roundf.Rounded)

# ----
ptsrfdomnum = SurfaceDomainNumber(Surface=orient.Geometry, UNumber=roundf_2.Rounded, VNumber=roundf.Rounded)
flip = FlipMatrix(Data=ptsrfdomnum)

# ---- group: Get Curvature (continued)
ptcenter = CenterGrid(Grid=flip, Surface=orient.Geometry)
points = PointList(Points=flatten(flip))

# ---- group: Get Curvature / Only neede for "classic" inverse - not smooth
srf_cp = SurfaceClosestPoint(Point=ptcenter, Surface=move.Geometry)  # -> Point, UVPoint, Distance
curvature_3 = PrincipalCurvature(Surface=move.Geometry, Point=srf_cp.UVPoint)  # -> Frame, flatten(Maximum), flatten(Minimum), flatten(MaxDirection), flatten(MinDirection)
devec_min = DeconstructVector(Vector=flatten(curvature_3.MinDirection))  # -> XComponent, YComponent, ZComponent
devec_max = DeconstructVector(Vector=flatten(curvature_3.MaxDirection))  # -> XComponent, YComponent, ZComponent
merge_all = Merge(
    Data1=graft(curvature_3.Maximum),
    Data2=graft(curvature_3.Minimum),
    Data3=graft(devec_max.XComponent),
    Data4=graft(devec_max.YComponent),
    Data5=graft(devec_max.ZComponent),
    Data6=graft(devec_min.XComponent),
    Data7=graft(devec_min.YComponent),
    Data8=graft(devec_min.ZComponent))

# ---- group: Visualize Vectors (continued)
multiplication = Multiplication(A=curvature_3.Minimum, B=number_slider_18)
multiplication_2 = Multiplication(A=curvature_3.Maximum, B=number_slider_18)
amp = Amplitude(Vector=curvature_3.MinDirection, Amplitude=multiplication)
amp_2 = Amplitude(Vector=curvature_3.MaxDirection, Amplitude=multiplication_2)
vdisex_2 = VectorDisplayEx(Point=flatten(srf_cp.Point), Vector=amp, Colour=ColourSwatch(SwatchColor=RGB(125, 255, 225)), Width=2)
vdisex_3 = VectorDisplayEx(Point=flatten(srf_cp.Point), Vector=amp_2, Colour=ColourSwatch(SwatchColor=RGB(0, 6, 171)), Width=2)

# ---- group: Original Surface Curvature
ptsrfdomnum_2 = SurfaceDomainNumber(Surface=srf, UNumber=roundf_2.Rounded, VNumber=roundf.Rounded)
ptcenter_2 = CenterGrid(Grid=ptsrfdomnum_2)
srf_cp_2 = SurfaceClosestPoint(Point=ptcenter_2, Surface=srf)  # -> Point, UVPoint, Distance
curvature_4 = PrincipalCurvature(Surface=srf, Point=srf_cp_2.UVPoint)  # -> Frame, flatten(Maximum), flatten(Minimum), flatten(MaxDirection), flatten(MinDirection)
swatch_5 = ColourSwatch(SwatchColor=RGB(255, 0, 0))
multiplication_3 = Multiplication(A=curvature_4.Maximum, B=number_slider_18)
multiplication_4 = Multiplication(A=curvature_4.Minimum, B=number_slider_18)
amp_3 = Amplitude(Vector=curvature_4.MinDirection, Amplitude=multiplication_4)
amp_4 = Amplitude(Vector=curvature_4.MaxDirection, Amplitude=multiplication_3)
vdisex_4 = VectorDisplayEx(Point=flatten(srf_cp.Point), Vector=amp_4, Colour=swatch_5, Width=2)
vdisex_5 = VectorDisplayEx(Point=flatten(srf_cp.Point), Vector=amp, Colour=swatch_5, Width=2)

# ----
flip_2 = FlipMatrix(Data=ptcenter_2)

multiplication_5 = Multiplication(A=curvature_3.Minimum, B=number_slider_19)  # disabled
multiplication_6 = Multiplication(A=curvature_3.Maximum, B=number_slider_19)  # disabled
amp_5 = Amplitude(Vector=curvature_3.MinDirection, Amplitude=multiplication_5)  # disabled
amp_6 = Amplitude(Vector=curvature_3.MaxDirection, Amplitude=multiplication_6)  # disabled
vdisex_6 = VectorDisplayEx(Point=flatten(flip_2), Vector=amp_5, Colour=swatch, Width=number_slider_5)  # disabled
vdisex_7 = VectorDisplayEx(Point=flatten(flip_2), Vector=amp_6, Colour=swatch_4, Width=number_slider_5)  # disabled

model_path_24_layers = Panel("C:\Gal_Msc\Ipublic-repo\inverse-model-frustrated-composites\saved_models\glowing-river.pkl")
max = Panel("""20.4
20.4
20.0""")
min = Panel("""-20.4
-20.4
-0.2""")
number_slider_20 = Slider(1, range=0..1)
number_slider_21 = Slider(3, range=0..10)
target_pt = Point(ptcenter)
flip_3 = FlipMatrix(Data=target_pt)  # -> simplify(Data)

# ----
# 3.Predict
inverse_prediction_smooth = Python3Script(
    features_max=max_smooth,
    features_min=min_smooth,
    x_cm=roundf_2.Rounded,
    y_cm=roundf.Rounded,
    n_of_features_channels=number_slider_6,
    model_path=path,
    xyz=simplify(ptcenter),
    sigma=number_slider_8,
    smoothing_method=smoothing_method,
    surface=rebuildsrf,
    rebuild_divide=number_slider_7)  # -> out, prediction, similarity_score, confidence_score, Z_smooth_out, X_out, Y_out; inputs features_max: list of Double, features_min: list of Double, dataset_mean: list of Double, dataset_std: list of Double, x_cm: Int32, y_cm: Int32, n_of_features_channels: Int32, xyz: tree of Point3d, sigma: Double, surface: Surface, rebuild_divide: Int32; disabled
# ---------- inverse_prediction_smooth: Python ----------
# ┌───────────────────────────────────────────────────────────────────────────┐
# │                      Imports and Definitions                              │
# └───────────────────────────────────────────────────────────────────────────┘
# venv: inverse_prediction_smooth
# r: numpy, pandas, torch, scipy
import ghpythonlib.treehelpers as th
import numpy as np
import torch 
import pandas as pd
from torch import nn
from scipy.ndimage import gaussian_filter
from scipy.ndimage import uniform_filter
from scipy.signal import savgol_filter
from scipy.interpolate import RectBivariateSpline
import torch.nn.functional as Functional

features_channels = n_of_features_channels 



# ┌───────────────────────────────────────────────────────────────────────────┐
# │                               Functions                                   │
# └───────────────────────────────────────────────────────────────────────────┘

def get_shape(lst):
    shape = []
    while isinstance(lst, list):
        shape.append(len(lst))
        lst = lst[0] if lst else []
    return tuple(shape)

def smooth_savgol(Z, sigma):
    window = int(2 * sigma + 1)
    if window % 2 == 0:
        window += 1
    Z_smooth = savgol_filter(Z, window_length=window, polyorder=2, axis=0)
    Z_smooth = savgol_filter(Z_smooth, window_length=window, polyorder=2, axis=1)
    # print(Z_smooth)
    return Z_smooth

def smooth_bilateral(Z, sigma):
    # Normalize and convert to 8-bit for OpenCV
    Z_norm = (Z - np.min(Z)) / (np.max(Z) - np.min(Z)) * 255
    Z_8bit = np.uint8(Z_norm)
    smoothed = cv2.bilateralFilter(Z_8bit, d=9, sigmaColor=75, sigmaSpace=sigma)
    return smoothed.astype(float) / 255 * (np.max(Z) - np.min(Z)) + np.min(Z)


def rebuild_full_surface_and_resample(X, Y, Z, coarse_shape):
    """
    Rebuilds the full surface Z using a coarse bivariate spline,
    and resamples it back to the original resolution using that smoothed fit.

    Parameters:
    - X, Y, Z: Original surface arrays (shape nx x ny)
    - coarse_shape: Tuple (u, v) — resolution of the smoothing surface

    Returns:
    - X_resampled, Y_resampled, Z_smooth: All shape (nx, ny)
    """
    nx, ny = X.shape

    u = max(3, coarse_shape[0])
    v = max(3, coarse_shape[1])

    # Extract coordinate vectors (structured grid assumption)
    x_vec = X[0, :]
    y_vec = Y[:, 0]

    # Step 1: Interpolate original surface
    spline_orig = RectBivariateSpline(y_vec, x_vec, Z)

    # Step 2: Sample coarse version of the surface
    x_coarse = np.linspace(x_vec.min(), x_vec.max(), u)
    y_coarse = np.linspace(y_vec.min(), y_vec.max(), v)
    Z_coarse = spline_orig(y_coarse, x_coarse)

    # Step 3: Fit new spline on coarse grid (this becomes the smoothed surface)
    kx = min(3, len(x_coarse) - 1)
    ky = min(3, len(y_coarse) - 1)
    spline_smooth = RectBivariateSpline(y_coarse, x_coarse, Z_coarse, kx=kx, ky=ky)


    # Step 4: Resample smoothed surface on original fine grid
    Z_smooth = spline_smooth(y_vec, x_vec)

    return X.copy(), Y.copy(), Z_smooth

def pad_tensor(max_h,max_w,tensor):

    """
    Pads a tensor of shape [1, C, H, W] to [1, C, 40, 40] using zero-padding.
    """


    _, _, h, w = tensor.shape
    pad_h = max_h - h
    pad_w = max_w - w

    return Functional.pad(tensor, (0, pad_w, 0, pad_h), mode='constant', value=0)

# ┌───────────────────────────────────────────────────────────────────────────┐
# │                             Model Class                                   │
# └───────────────────────────────────────────────────────────────────────────┘

class OurVgg16Old(torch.nn.Module):
    def __init__(self, dropout=0.3):
        super(OurVgg16, self).__init__()

        self.conv_1 = torch.nn.Conv2d(in_channels=features_channels, out_channels=64, kernel_size=3, padding=1)
        self.conv_2 = torch.nn.Conv2d(in_channels=64, out_channels=128, kernel_size=3, padding=1)
        self.conv_3 = torch.nn.Conv2d(in_channels=128, out_channels=128, kernel_size=3, padding=1)
        self.conv_4 = torch.nn.Conv2d(in_channels=128, out_channels=256, kernel_size=3, padding=1)
        self.conv_5 = torch.nn.Conv2d(in_channels=256, out_channels=256, kernel_size=3, padding=1)
        self.conv_6 = torch.nn.Conv2d(in_channels=256, out_channels=512, kernel_size=3, padding=1)
        self.conv_7 = torch.nn.Conv2d(in_channels=512, out_channels=512, kernel_size=3, padding=1)
        self.conv_8 = torch.nn.Conv2d(in_channels=512, out_channels=512, kernel_size=3, padding=1)
        self.conv_9 = torch.nn.Conv2d(in_channels=512, out_channels=512, kernel_size=3, padding=1)
        self.conv_10 = torch.nn.Conv2d(in_channels=512, out_channels=256, kernel_size=3, padding=1)
        self.conv_11 = torch.nn.Conv2d(in_channels=256, out_channels=256, kernel_size=3, padding=1)
        self.conv_12 = torch.nn.Conv2d(256, 128, kernel_size=3, padding=1)
        self.conv_13 = torch.nn.Conv2d(128, 128, kernel_size=3, padding=1)
        self.conv_14 = torch.nn.Conv2d(128, 1, kernel_size=3, padding=1)

        self.batch_norm_1 = torch.nn.BatchNorm2d(num_features=64)
        self.batch_norm_2 = torch.nn.BatchNorm2d(num_features=128)
        self.batch_norm_3 = torch.nn.BatchNorm2d(num_features=128)
        self.batch_norm_4 = torch.nn.BatchNorm2d(num_features=256)
        self.batch_norm_5 = torch.nn.BatchNorm2d(num_features=256)
        self.batch_norm_6 = torch.nn.BatchNorm2d(num_features=512)
        self.batch_norm_7 = torch.nn.BatchNorm2d(num_features=512)
        self.batch_norm_8 = torch.nn.BatchNorm2d(num_features=512)
        self.batch_norm_9 = torch.nn.BatchNorm2d(num_features=512)
        self.batch_norm_10 = torch.nn.BatchNorm2d(num_features=256)
        self.batch_norm_11 = torch.nn.BatchNorm2d(num_features=256)
        self.batch_norm_12 = torch.nn.BatchNorm2d(num_features=128)
        self.batch_norm_13 = torch.nn.BatchNorm2d(num_features=128)
        self.batch_norm_14 = torch.nn.BatchNorm2d(num_features=1)

        self.relu = torch.nn.ReLU()
        self.dropout = torch.nn.Dropout(p=dropout)
        self.sigmoid = nn.Sigmoid()

    def forward(self, x):
        x = self.conv_1(x); x = self.batch_norm_1(x); x = self.relu(x)
        x = self.conv_2(x); x = self.batch_norm_2(x); x = self.relu(x)
        x = self.conv_3(x); x = self.batch_norm_3(x); x = self.relu(x)
        x = self.conv_4(x); x = self.batch_norm_4(x); x = self.relu(x)
        x = self.conv_5(x); x = self.batch_norm_5(x); x = self.relu(x)
        x = self.conv_6(x); x = self.batch_norm_6(x); x = self.relu(x)
        x = self.conv_7(x); x = self.batch_norm_7(x); x = self.relu(x)
        x = self.conv_8(x); x = self.batch_norm_8(x); x = self.relu(x)
        x = self.conv_9(x); x = self.batch_norm_9(x); x = self.relu(x)
        x = self.conv_10(x); x = self.batch_norm_10(x); x = self.relu(x)
        x = self.conv_11(x); x = self.batch_norm_11(x); x = self.relu(x)
        x = self.conv_12(x); x = self.batch_norm_12(x); x = self.relu(x)
        x = self.conv_13(x); x = self.batch_norm_13(x); x = self.relu(x)
        x = self.conv_14(x); x = self.sigmoid(x)
        return x

class OurVgg16(torch.nn.Module):
    def __init__(self, dropout=0.3):
        super(OurVgg16, self).__init__()

        self.conv_1 = torch.nn.Conv2d(in_channels=features_channels, out_channels=64, kernel_size=3, padding=1)
        self.conv_2 = torch.nn.Conv2d(in_channels=64, out_channels=128, kernel_size=3, padding=1)
        self.conv_3 = torch.nn.Conv2d(in_channels=128, out_channels=128, kernel_size=3, padding=1)
        self.conv_4 = torch.nn.Conv2d(in_channels=128, out_channels=256, kernel_size=3, padding=1)
        self.conv_5 = torch.nn.Conv2d(in_channels=256, out_channels=256, kernel_size=3, padding=1)
        self.conv_6 = torch.nn.Conv2d(in_channels=256, out_channels=512, kernel_size=3, padding=1)
        self.conv_7 = torch.nn.Conv2d(in_channels=512, out_channels=512, kernel_size=3, padding=1)
        self.conv_8 = torch.nn.Conv2d(in_channels=512, out_channels=512, kernel_size=3, padding=1)
        self.conv_9 = torch.nn.Conv2d(in_channels=512, out_channels=512, kernel_size=3, padding=1)
        self.conv_10 = torch.nn.Conv2d(in_channels=512, out_channels=256, kernel_size=3, padding=1)
        self.conv_11 = torch.nn.Conv2d(in_channels=256, out_channels=256, kernel_size=3, padding=1)
        self.conv_12 = torch.nn.Conv2d(256, 128, kernel_size=3, padding=1)
        self.conv_13 = torch.nn.Conv2d(128, 128, kernel_size=3, padding=1)
        # self.conv_14 = torch.nn.Conv2d(128, labels_channels, kernel_size=3, padding=1)

        # Testing FC layer
        self.conv_fc1 = torch.nn.Conv2d(128, 512, kernel_size=3, padding=1)
        self.norm_fc1 = torch.nn.BatchNorm2d(512)
        self.relu_fc1 = torch.nn.ReLU()
        self.drop_fc1 = torch.nn.Dropout(p=dropout)
        self.conv_fc2 = torch.nn.Conv2d(512, labels_channels, kernel_size=1)


        self.batch_norm_1 = torch.nn.BatchNorm2d(num_features=64)
        self.batch_norm_2 = torch.nn.BatchNorm2d(num_features=128)
        self.batch_norm_3 = torch.nn.BatchNorm2d(num_features=128)
        self.batch_norm_4 = torch.nn.BatchNorm2d(num_features=256)
        self.batch_norm_5 = torch.nn.BatchNorm2d(num_features=256)
        self.batch_norm_6 = torch.nn.BatchNorm2d(num_features=512)
        self.batch_norm_7 = torch.nn.BatchNorm2d(num_features=512)
        self.batch_norm_8 = torch.nn.BatchNorm2d(num_features=512)
        self.batch_norm_9 = torch.nn.BatchNorm2d(num_features=512)
        self.batch_norm_10 = torch.nn.BatchNorm2d(num_features=256)
        self.batch_norm_11 = torch.nn.BatchNorm2d(num_features=256)
        self.batch_norm_12 = torch.nn.BatchNorm2d(num_features=128)
        self.batch_norm_13 = torch.nn.BatchNorm2d(num_features=128)
        # self.batch_norm_14 = torch.nn.BatchNorm2d(num_features=1)


        self.relu = torch.nn.ReLU()
        self.dropout = torch.nn.Dropout(p=dropout)

        self.sigmoid = nn.Sigmoid()

    def forward(self, x):
        x = self.conv_1(x)
        x = self.batch_norm_1(x)
        x = self.relu(x)
        # x = self.dropout(x)

        x = self.conv_2(x)
        x = self.batch_norm_2(x)
        x = self.relu(x)
        # x = self.dropout(x)

        x = self.conv_3(x)
        x = self.batch_norm_3(x)
        x = self.relu(x)
        # x = self.dropout(x)

        x = self.conv_4(x)
        x = self.batch_norm_4(x)
        x = self.relu(x)
        # x = self.dropout(x)

        x = self.conv_5(x)
        x = self.batch_norm_5(x)
        x = self.relu(x)
        # x = self.dropout(x)

        x = self.conv_6(x)
        x = self.batch_norm_6(x)
        x = self.relu(x)
        # x = self.dropout(x)

        x = self.conv_7(x)
        x = self.batch_norm_7(x)
        x = self.relu(x)
        # x = self.dropout(x)

        x = self.conv_8(x)
        x = self.batch_norm_8(x)
        x = self.relu(x)
        # x = self.dropout(x)

        x = self.conv_9(x)
        x = self.batch_norm_9(x)
        x = self.relu(x)
        # x = self.dropout(x)

        x = self.conv_10(x)
        x = self.batch_norm_10(x)
        x = self.relu(x)
        # x = self.dropout(x)

        x = self.conv_11(x)
        x = self.batch_norm_11(x)
        x = self.relu(x)
        # x = self.dropout(x)

        x = self.conv_12(x)
        x = self.batch_norm_12(x)
        x = self.relu(x)
        # x = self.dropout(x)

        x = self.conv_13(x)
        x = self.batch_norm_13(x)
        x = self.relu(x)
        # x = self.dropout(x)
        # print(f"after conv13 {x.shape}")

        # x = self.conv_14(x)
        # x = self.batch_norm_14(x)
        # x = self.relu(x)
        # x = self.dropout(x)
        # print(f"after conv14 {x.shape}")

        # Testing FC layer
        x = self.conv_fc1(x)
        x = self.norm_fc1(x)
        x = self.relu_fc1(x)
        x = self.drop_fc1(x)
        x = self.conv_fc2(x)

        x = self.sigmoid(x)


        return x

# ┌───────────────────────────────────────────────────────────────────────────┐
# │                           Main Code                                       │
# └───────────────────────────────────────────────────────────────────────────┘

labels_channels = 1
# Flatten XYZ tree to list of Point3d
xyz_flat = [pt for i in range(xyz.BranchCount) for pt in xyz.Branch(i)]
xyz_array = np.array([[pt.X, pt.Y, pt.Z] for pt in xyz_flat])

X = xyz_array[:, 0].reshape((y_cm, x_cm), order='F')
Y = xyz_array[:, 1].reshape((y_cm, x_cm), order='F')
Z = xyz_array[:, 2].reshape((y_cm, x_cm), order='F')

# Smooth Z using selected method
if smoothing_method == 'gaussian':
    Z_smooth = gaussian_filter(Z, sigma=sigma)
    # print("    Applied Gaussian smoothing")
elif smoothing_method == 'uniform':
    Z_smooth = uniform_filter(Z, size=int(2 * sigma + 1))
    # print("    Applied uniform smoothing")
elif smoothing_method == 'median':
    Z_smooth = median_filter(Z, size=int(2 * sigma + 1))
    # print("    Applied median smoothing")
elif smoothing_method == 'savgol':
    Z_smooth = smooth_savgol(Z, sigma)
    print("    Applied savgol smoothing")
elif smoothing_method == 'bilateral':
    Z_smooth = smooth_bilateral(Z, sigma)
elif smoothing_method == 'anisotropic':
    Z_smooth = denoise_tv_chambolle(Z, weight=sigma)
elif smoothing_method == 'rebuild':
    rebuild_shape = (x_cm // rebuild_divide, y_cm // rebuild_divide)
    X, Y, Z_smooth = rebuild_full_surface_and_resample(X, Y, Z, rebuild_shape)
else:
    raise ValueError(f"Unsupported smoothing method: {smoothing_method}")

print(Z_smooth.shape)
Z_smooth_out = th.list_to_tree(Z_smooth.tolist())
X_out = th.list_to_tree(X.tolist())
Y_out = th.list_to_tree(Y.tolist())

# UV parameter extraction
uv_flat = [surface.ClosestPoint(pt) for pt in xyz_flat]
uv_array = np.array([[uv[1], uv[2]] for uv in uv_flat])

U = uv_array[:, 0].reshape((y_cm, x_cm), order='F')
V = uv_array[:, 1].reshape((y_cm, x_cm), order='F')

# Derivatives in U,V parameterization
du = dv = 1.0
Zu, Zv = np.gradient(Z_smooth, du, dv)
Zuu, Zuv = np.gradient(Zu, du, dv)
_, Zvv = np.gradient(Zv, du, dv)

# Fundamental forms (U,V)
E = Zu**2 + 1
F = Zu * Zv
G = Zv**2 + 1
L = Zuu
M = Zuv
N = Zvv

# Curvature computation

denom = E * G - F**2
sqrt_term = np.sqrt(np.clip((L * G - 2 * M * F + N * E)**2 - 4 * denom * (L * N - M**2), a_min=0, a_max=None))
k1 = ((L * G - 2 * M * F + N * E) + sqrt_term) / (2 * denom)
k2 = ((L * G - 2 * M * F + N * E) - sqrt_term) / (2 * denom)

# Max/Min curvature and vectors
k1_flat = k1.flatten(order='F')
k2_flat = k2.flatten(order='F')
use_k1_as_max = np.abs(k1_flat) >= np.abs(k2_flat)
max_curv = np.where(use_k1_as_max, k1_flat, k2_flat)
min_curv = np.where(use_k1_as_max, k2_flat, k1_flat)

# Principal directions remain XYZ-based for simplicity
# (original XYZ-based derivatives Zx,Zy needed here)
dx = dy = 1.0
Zx, Zy = np.gradient(Z_smooth, dx, dy)
Zxx, Zxy = np.gradient(Zx, dx, dy)
_, Zyy = np.gradient(Zy, dx, dy)

principal_dirs_max = np.zeros((y_cm, x_cm, 3))
principal_dirs_min = np.zeros((y_cm, x_cm, 3))

for ix in range(y_cm):
    for iy in range(x_cm):
        H = np.array([[Zxx[ix, iy], Zxy[ix, iy]], [Zxy[ix, iy], Zyy[ix, iy]]])
        eigvals, eigvecs = np.linalg.eigh(H)
        idx = np.argsort(np.abs(eigvals))[::-1]
        v_max = eigvecs[:, idx[0]]
        v_min = eigvecs[:, idx[1]]
        dzdx, dzdy = Zx[ix, iy], Zy[ix, iy]
        normal = np.array([-dzdx, -dzdy, 1.0])
        normal /= np.linalg.norm(normal)
        d_max = np.array([v_max[0], v_max[1], v_max[0]*dzdx + v_max[1]*dzdy])
        d_min = np.array([v_min[0], v_min[1], v_min[0]*dzdx + v_min[1]*dzdy])
        d_max -= np.dot(d_max, normal) * normal
        d_min -= np.dot(d_min, normal) * normal
        principal_dirs_max[ix, iy] = d_max / np.linalg.norm(d_max)
        principal_dirs_min[ix, iy] = d_min / np.linalg.norm(d_min)
max_vecs = (principal_dirs_max * np.abs(max_curv).reshape((y_cm, x_cm), order='F')[:, :, np.newaxis]).reshape(-1, 3, order='F')
min_vecs = (principal_dirs_min * np.abs(min_curv).reshape((y_cm, x_cm), order='F')[:, :, np.newaxis]).reshape(-1, 3, order='F')

# Rebuild curvature array
curvature_array = np.zeros((len(xyz_flat), 8))
curvature_array[:, 0] = max_curv
curvature_array[:, 1] = min_curv
curvature_array[:, 2:5] = max_vecs
curvature_array[:, 5:8] = min_vecs
print("Curvature array shape:", curvature_array.shape)

# Reshape and stack
reshaped_channels = [np.reshape(curvature_array[:, i], (y_cm, x_cm), order='F') for i in range(n_of_features_channels)]
feature_array = np.stack(reshaped_channels, axis=-1)
print("Feature array shape (H, W, C):", feature_array.shape)

# Convert to Tensor
feature_tensor = torch.from_numpy(feature_array).unsqueeze(0).permute(0, 3, 1, 2).float()
print("Feature tensor shape (B, C, H, W):", feature_tensor.shape)

# Normalize
min_tensor = torch.tensor(features_min).view(1, 8, 1, 1)
max_tensor = torch.tensor(features_max).view(1, 8, 1, 1)
feature_tensor = (feature_tensor - min_tensor) / (max_tensor - min_tensor)
print("Normalization complete.")

# 🟡 Save original size before padding
_, _, orig_h, orig_w = feature_tensor.shape


# Pad normalized input to match training shape
feature_tensor = pad_tensor(40,40, feature_tensor)

# Load and predict
model = OurVgg16()
model.load_state_dict(torch.load(model_path, map_location=torch.device('cpu')))
model.eval()
print("Model loaded and set to eval mode.")

# Step 3: Model inference
import time
start_time = time.time()
with torch.no_grad():
    prediction = model(feature_tensor)
    print("Prediction shape:", prediction.shape)
end_time = time.time()
print(f"Inference time: {end_time - start_time:.4f} seconds")
# crop
prediction = prediction[:, :, :orig_h, :orig_w]


denorm_prediction = prediction * 180.0
prediction_np = denorm_prediction.squeeze().numpy()
prediction = prediction_np.flatten(order='F').tolist()
print("Prediction complete and flattened.")
# ---------- end inverse_prediction_smooth ----------
multiplication_7 = Multiplication(A=roundf_2.Rounded, B=roundf.Rounded)  # disabled
prediction = Number(inverse_prediction_smooth.prediction)  # disabled

# ---- group: Get Average Per Patch
item_2 = ListItem(List=flatten(flip), Index=0, Wrap=True)
int = Integer(roundf_2.Rounded)
int_2 = Integer(roundf.Rounded)
int_3 = Integer(prediction)
patch_average = Python3Script(
    angles=int_3,
    x_cm=int,
    y_cm=int_2,
    patch_x=patch_size,
    patch_y=patch_size,
    is_weighted=Toggle(True),
    weight=w,
    is_concentric=Toggle(True))  # -> out, patches_avgs, flat_avg; inputs angles: list of Double, x_cm: Int32, patch_x: Int32, patch_y: Int32, is_weighted: Boolean, weight: Double, is_concentric: Boolean
# ---------- patch_average: Python ----------
# r: numpy
# venv: patch_average

"""
Compute averaged values over patches in a 2D angle grid, with optional spatial weighting.

This script processes a flattened list of angles arranged in a (y_cm, x_cm) grid, dividing it into patches of size (patch_y, patch_x). 
Each patch's average is computed, optionally using either concentric (layered) or Gaussian-like spatial weighting.

Parameters:
- angles: flat list of angle values (0–180), ordered column-first (Fortran-style).
- y_cm, x_cm: dimensions of the grid.
- patch_y, patch_x: height and width of each patch.
- is_weighted: if True, use weighted averaging; otherwise, use simple mean.
- weight: float value > 0 controlling how strongly the weighting favors the patch center.
    - For concentric: higher = more center-heavy decay by layer.
    - For radial (Gaussian-like): higher = sharper falloff from center to edges.
- is_concentric: 
    - If True: uses concentric shell (layer-based) weighting — all pixels in a ring around the center have the same weight.
    - If False: uses radial (Euclidean distance) Gaussian-style decay.

Returns:
- flat_avg: list of patch-averaged values, flattened column-first.
- Prints patch locations, involved indices, raw values, and calculated averages for debugging.
"""

import numpy as np

grid = np.array(angles).reshape((y_cm, x_cm), order='F')  # (15, 20)

patch_avgs = []
for i in range(0, y_cm, patch_y):
    row = []
    for j in range(0, x_cm, patch_x):
        patch = grid[i:i+patch_y, j:j+patch_x]
        if is_concentric:
            if is_weighted:
                cy, cx = patch.shape[0] // 2, patch.shape[1] // 2
                yy, xx = np.meshgrid(np.arange(patch.shape[0]), np.arange(patch.shape[1]), indexing='ij')
                
                # Compute concentric "layer" distances (Manhattan shells)
                layer = np.maximum(np.abs(yy - cy), np.abs(xx - cx))  # same layer = same weight
                
                # Assign weights: inner layers get higher weights
                decay = np.power(1.0 / weight, layer)
                
                # Normalize so the sum of weights is 1
                decay /= np.sum(decay)
                
                # Weighted average
                avg = np.sum(patch * decay)
            else:
                avg = np.mean(patch)
        else:
            if is_weighted:
                cy, cx = patch.shape[0] // 2, patch.shape[1] // 2
                yy, xx = np.meshgrid(np.arange(patch.shape[0]), np.arange(patch.shape[1]), indexing='ij')
                distances = np.sqrt((yy - cy)**2 + (xx - cx)**2)
                max_dist = np.sqrt(cy**2 + cx**2) or 1
                decay = np.exp(-weight * (distances / max_dist)**2)
                decay /= np.sum(decay)  # normalize to sum=1
                avg = np.sum(patch * decay)
            else:
                avg = np.mean(patch)


        # Calculate original flat indices from angles
        indices = []
        for dy in range(patch_y):
            for dx in range(patch_x):
                iy = i + dy
                jx = j + dx
                if iy < y_cm and jx < x_cm:
                    flat_index = iy * x_cm + jx
                    indices.append(flat_index)

        print(f"Patch (row={i//patch_y}, col={j//patch_x})")
        print(f"  Flat indices: {indices}")
        print(f"  Values: {[angles[k] for k in indices]}")
        print(f"  Average: {avg}")
        row.append(avg)
    patch_avgs.append(row)

flat_avg = np.array(patch_avgs).flatten(order='F').tolist()
# ---------- end patch_average ----------
division = Division(A=roundf_2.Rounded, B=patch_size)
division_2 = Division(A=roundf.Rounded, B=patch_size)
recgrid = Rectangular(Plane=item_2, SizeX=patch_size, SizeY=patch_size, ExtentX=division, ExtentY=division_2)  # -> flatten(Cells), flatten(Points)
area_2 = Area(Geometry=recgrid.Cells)  # -> Area, Centroid
panel_13 = Panel(patch_average.flat_avg)
round = Round(Number=patch_average.flat_avg)  # -> Nearest, Floor, Ceiling

# ---- group: Get Flat Grid
rectangle = Rectangle(Plane=item_2, XSize=roundf_2.Rounded, YSize=roundf.Rounded, Radius=0)  # -> Rectangle, Length
sdivide_4 = DivideSurface(Surface=rectangle.Rectangle, UCount=roundf_2.Rounded, VCount=roundf.Rounded)  # -> Points, Normals, Parameters
ptcell = Cellulate(Grid=sdivide_4.Points)  # -> Wires, Cells, flatten(Meshes)
area_3 = MeshArea(Mesh=ptcell.Meshes)  # -> Area, Centroid

# ---- group: Visulization Per Pixel
round_2 = Round(Number=prediction)  # -> Nearest, Floor, Ceiling
gradient = Gradient(
    LowerLimit=0,
    UpperLimit=180,
    Parameter=round_2.Nearest,
    stops=[0: RGB(243, 57, 0), 0.1: RGB(236, 27, 60), 0.2: RGB(210, 0, 118), 0.3: RGB(103, 0, 120), 0.4: RGB(39, 72, 161), 0.5: RGB(1, 192, 229), 0.6: RGB(18, 178, 90), 0.7: RGB(79, 186, 8), 0.8: RGB(220, 237, 32), 0.9: RGB(247, 159, 20), 1: RGB(243, 57, 0)])
# 4. Preview Fiber Prediction
ptcell_2 = Cellulate(Grid=flip)  # -> Wires, Cells, flatten(Meshes)
preview_3 = CustomPreview(Geometry=flatten(ptcell.Meshes), Material=gradient)
tag_2 = TextTag(Location=flatten(area_3.Centroid), Text=round_2.Nearest, Colour=swatch_2)

# ---- group: Confidence
# ~0: Very similar
# >2 or 3: Outlier
similarity_to_dataset = Panel(inverse_prediction_smooth.similarity_score)

# 1 = High Confidence
# 0 = Low Confidence
confidence = Panel(inverse_prediction_smooth.confidence_score)

# ---- group: Display Smoothing
number_slider_22 = Slider(0, range=0..100)  # disabled
number_slider_23 = Slider(0.5, range=0..1)  # disabled
pt = ConstructPoint(
    XCoordinate=inverse_prediction_smooth.X_out,
    YCoordinate=inverse_prediction_smooth.Y_out,
    ZCoordinate=inverse_prediction_smooth.Z_smooth_out)  # disabled
orient_3 = Orient(Geometry=ptcenter_2, Source=area.Centroid, Target=xy)  # -> Geometry, Transform; disabled
dist_2 = Distance(PointA=simplify(orient_3.Geometry), PointB=simplify(pt))  # -> flatten(Distance); disabled
gradient_2 = Gradient(
    LowerLimit=number_slider_22,
    UpperLimit=number_slider_23,
    Parameter=dist_2,
    stops=[0: RGB(0, 128, 0), 0.5: RGB(255, 255, 0), 1: RGB(255, 0, 0)])  # disabled
preview_4 = CustomPreview(Geometry=flatten(pt), Material=flatten(gradient_2))  # disabled

# ---- group: Calculate weighed chamfer distance / Concentric Weights
dom = ConstructDomain(DomainStart=number_slider_10, DomainEnd=number_slider_9)  # disabled
concentric_weights = Python3Script(xCount=roundf_2.Rounded, yCount=roundf.Rounded, weightDomain=dom)  # -> out, weights; inputs xCount: Int32, yCount: Int32, weightDomain: Interval; disabled
# ---------- concentric_weights: Python ----------
import rhinoscriptsyntax as rs
from ghpythonlib.treehelpers import list_to_tree

# Inputs:
# xCount: number of columns
# yCount: number of rows
# weightDomain: Grasshopper Domain (e.g. 0 to 1 or 1 to 0)

def remap(value, source_min, source_max, target_min, target_max):
    if source_max == source_min:
        return target_min  # avoid divide by zero
    t = (value - source_min) / float(source_max - source_min)
    return target_min + t * (target_max - target_min)

weights = []
# Optional: grid points to visualize the structure
gridPts = []

max_depth = min(xCount, yCount) // 2

for y in range(yCount):
    for x in range(xCount):
        # Distance to each edge
        d_left = x
        d_right = xCount - 1 - x
        d_top = y
        d_bottom = yCount - 1 - y
        
        depth = min(d_left, d_right, d_top, d_bottom)

        # Normalize: 0 = center, 1 = edge
        if max_depth > 0:
            normalized = 1.0 - (depth / float(max_depth))
        else:
            normalized = 1.0

        # Remap to domain
        weight = remap(normalized, 0.0, 1.0, weightDomain.T0, weightDomain.T1)
        weights.append(weight)

        # Optional grid point (remove if not needed)
        # gridPts.append(rs.AddPoint(x, y, 0))

# Outputs:
# weights: flattened list
# gridPts: optional for visualization
# ---------- end concentric_weights ----------

# ---- group: Display Smoothing / OG
swatch_6 = ColourSwatch(SwatchColor=RGB(187, 255, 0))  # disabled
preview_5 = CustomPreview(Geometry=orient_3.Geometry, Material=swatch_6)  # disabled

# ---- group: Display Smoothing / After Smoothing
swatch_7 = ColourSwatch(SwatchColor=RGB(188, 153, 224))  # disabled
preview_6 = CustomPreview(Geometry=pt, Material=swatch_7)  # disabled

# ---- group: Display Smoothing / Middle
swatch_8 = ColourSwatch(SwatchColor=RGB(0, 17, 255))  # disabled
preview_7 = CustomPreview(Geometry=ptcenter, Material=swatch_8)  # disabled

# ---- group: Target
pt_2 = Point(ptcenter)  # disabled
srf_4 = Surface(rebuildsrf)  # disabled

# ----
w_2 = Slider(5, range=0.1..50)
X = UnitX(Factor=1)
angle = Angle(VectorA=curvature_3.MaxDirection, VectorB=X)  # -> Angle, Reflex
inverse_prediction = Panel(round.Nearest)
deg = Degrees(Radians=angle.Angle)

addition_2 = Addition(A=deg, B=90)
panel_14 = Panel(addition_2)

patch_average_2 = Python3Script(
    angles=addition_2,
    x_cm=int,
    y_cm=int_2,
    patch_x=patch_size,
    patch_y=patch_size,
    is_weighted=Toggle(True),
    weight=w_2,
    is_concentric=Toggle(True))  # -> out, patches_avgs, flat_avg; inputs angles: list of Double, x_cm: Int32, patch_x: Int32, patch_y: Int32, is_weighted: Boolean, weight: Double, is_concentric: Boolean; same code as patch_average

# ---- group: Apply Symmetry
larger = LargerThan(FirstNumber=patch_average_2.flat_avg, SecondNumber="180")  # -> LargerThan, OrEqualTo
dispatch = Dispatch(List=patch_average_2.flat_avg, DispatchPattern=larger.LargerThan)  # -> ListA, ListB
subtraction_3 = Subtraction(A=dispatch.ListA, B="180")
weave = Weave(Pattern=larger.LargerThan, Stream0=dispatch.ListB, Stream1=subtraction_3, NullGaps=False)

# ----
recommended_start = Panel(weave)

# ---- group: Optimizer
flatten = FlattenTree(Tree=flip_3, Path="{0}")
forward_optimization_xyz = Python3Script(
    labels_max=max,
    labels_min=min,
    x_cm=roundf_2.Rounded,
    y_cm=roundf.Rounded,
    patch_x=patch_size,
    patch_y=patch_size,
    n_of_features_channels=number_slider_21,
    n_of_labels_channels=number_slider_20,
    model_path=model_path_24_layers,
    step_num=Slider(1000, range=0..10000),
    target=flatten,
    initial_angles=reverse(recommended_start))  # -> out, pred_prev, target_prev, angles_out; inputs labels_max: list of Double, labels_min: list of Double, x_cm: Int32, y_cm: Int32, patch_x: Int32, patch_y: Int32, n_of_features_channels: Int32, n_of_labels_channels: Int32, step_num: Int32, target: list of Point3d, initial_angles: list of Double
# ---------- forward_optimization_xyz: Python ----------
# ┌───────────────────────────────────────────────────────────────────────────┐
# │                      Imports and Definitions                              │
# └───────────────────────────────────────────────────────────────────────────┘
# venv: forward_prediction_XYZ
# r: numpy, torch, matplotlib, pathlib, open3d, wandb

import time
import os

import wandb
import numpy as np
import torch 
import torch.nn as nn
from torch.optim.lr_scheduler import ReduceLROnPlateau
from Grasshopper import DataTree
from Grasshopper.Kernel.Data import GH_Path
import matplotlib
import matplotlib.pyplot as plt
matplotlib.use('Agg')  # Use a non-interactive backend
from pathlib import Path
import torch.nn.functional as F
import Rhino.Geometry as rg
import open3d as o3d
from scipy.stats import qmc

features_channels = n_of_labels_channels 
labels_channels =  n_of_features_channels 

step_num = 10000

# ┌───────────────────────────────────────────────────────────────────────────┐
# │                               Functions                                   │
# └───────────────────────────────────────────────────────────────────────────┘

def duplicate_pixel_data(input_data, x_cm, y_cm, patch_x, patch_y, fortran_order=False):
    """
    Duplicates coarse grid values into patches in a larger tensor.
    
    Args:
        input_data (list, np.ndarray, or torch.Tensor): Either flat or 2D grid of values.
        x_cm (int): Width of output grid.
        y_cm (int): Height of output grid.
        patch_x (int): Width of each patch.
        patch_y (int): Height of each patch.
        fortran_order (bool): Whether to interpret flat input in column-major (Fortran) order.

    Returns:
        torch.Tensor: 4D tensor of shape (1, 1, y_cm, x_cm) with duplicated values.
    """
    num_patches_y = y_cm // patch_y
    num_patches_x = x_cm // patch_x
    expected_size = num_patches_y * num_patches_x

    # Convert input to torch tensor
    if isinstance(input_data, torch.Tensor):
        tensor_input = input_data
    elif isinstance(input_data, np.ndarray):
        tensor_input = torch.tensor(input_data, dtype=torch.float32)
    elif isinstance(input_data, list):
        tensor_input = torch.tensor(input_data, dtype=torch.float32)
    else:
        raise TypeError("Unsupported input type")

    # Handle flat input: reshape into 2D grid
    if tensor_input.dim() == 1:
        assert tensor_input.numel() == expected_size, f"Expected {expected_size} values, got {tensor_input.numel()}"
        if fortran_order:
            np_input = tensor_input.numpy().reshape((num_patches_y, num_patches_x), order='F')
            tensor_input = torch.tensor(np_input, dtype=torch.float32)
        else:
            tensor_input = tensor_input.view(num_patches_y, num_patches_x)

    final_tensor = torch.zeros((1, 1, y_cm, x_cm), dtype=torch.float32)

    for i in range(num_patches_y):
        for j in range(num_patches_x):
            row_start = i * patch_y
            row_end = row_start + patch_y
            col_start = j * patch_x
            col_end = col_start + patch_x
            final_tensor[:, 0, row_start:row_end, col_start:col_end] = tensor_input[i, j]


    return final_tensor


def duplicate_pixel_data_torch(input_data, x_cm, y_cm, patch_x, patch_y, fortran_order=False):
    num_patches_y = y_cm // patch_y
    num_patches_x = x_cm // patch_x
    expected_size = num_patches_y * num_patches_x

    # --- 1. Convert input to tensor (keeps gradient if it's already a Parameter)
    if not isinstance(input_data, torch.Tensor):
        tensor_input = torch.tensor(input_data, dtype=torch.float32)
    else:
        tensor_input = input_data

    # --- 2. Reshape flat input to 2D grid if needed
    if tensor_input.dim() == 1:
        assert tensor_input.numel() == expected_size, \
            f"Expected {expected_size} values, got {tensor_input.numel()}"
        if fortran_order:
            tensor_input = tensor_input.view(num_patches_x, num_patches_y).T
        else:
            tensor_input = tensor_input.view(num_patches_y, num_patches_x)

    # --- 3. Expand each value into its patch (vectorized)
    # Add channel/batch dims: (1, 1, num_patches_y, num_patches_x)
    tensor_input = tensor_input.unsqueeze(0).unsqueeze(0)

    # Expand along height and width
    tensor_expanded = tensor_input.repeat_interleave(patch_y, dim=2).repeat_interleave(patch_x, dim=3)
    # tensor_expanded now has shape (1, 1, y_cm, x_cm)

    return tensor_expanded


def tensor_to_spatial_tree(tensor):
    """
    Converts a [1, C, H, W] tensor into a DataTree[float] with each {h,w} as a branch
    containing C channel values.
    """
    tree = DataTree[float]()
    tensor = tensor.detach().squeeze(0)  # shape: [C, H, W]
    C, H, W = tensor.shape
    print(f"tensor shape before conversion: {C}, {H}, {W}")

    for y in range(H):
        for x in range(W):
            path = GH_Path(y, x)
            for ch in range(C):
                tree.Add(float(tensor[ch, y, x]), path)

    return tree

def chamfer_loss_with_registration(predicted, target):
    # Flatten from (1,3,x,y) to (N,3)
    P = predicted.permute(0, 2, 3, 1).reshape(-1, 3)
    Q = target.permute(0, 2, 3, 1).reshape(-1, 3)

    # Align predicted to target  - Simple
    P_aligned = rough_align(P, Q)
    # P_aligned, R, t = torch_icp(P, Q, iters=8, blend=0.3)
    # P_aligned = P


    # Compute Chamfer
    diff = P_aligned.unsqueeze(1) - Q.unsqueeze(0)  # (N, N, 3)
    dist = torch.sum(diff**2, dim=2)
    min_P_to_Q = dist.min(dim=1)[0]
    min_Q_to_P = dist.min(dim=0)[0]
    loss = min_P_to_Q.mean() + min_Q_to_P.mean()

    #  RESHAPE back to (1, 3, y, x) for preview
    y_dim, x_dim = predicted.shape[2], predicted.shape[3]
    prediction_aligned_grid = P_aligned.T.reshape(1, 3, y_dim, x_dim)

    return loss, prediction_aligned_grid

def chamfer_loss_weighted_edges(predicted, target, edge_weight=25.0):
    """
    Chamfer loss with additional emphasis on edge points.
    `edge_weight`: multiplier applied to loss for boundary points only.
    """
    # Flatten from (1, 3, H, W) to (N, 3)
    B, C, H, W = predicted.shape
    P = predicted.permute(0, 2, 3, 1).reshape(-1, 3)  # (B*H*W, 3)
    Q = target.permute(0, 2, 3, 1).reshape(-1, 3)

    # Align predicted to target
    P_aligned = rough_align(P, Q)

    # Create edge masks (1 if boundary, 0 otherwise) for both predicted and target
    edge_mask = torch.zeros((H, W), dtype=torch.bool, device=predicted.device)
    edge_mask[0, :] = edge_mask[-1, :] = edge_mask[:, 0] = edge_mask[:, -1] = True
    edge_mask_flat = edge_mask.flatten()

    # Compute Chamfer distances
    diff = P_aligned.unsqueeze(1) - Q.unsqueeze(0)  # (N, N, 3)
    dist = torch.sum(diff**2, dim=2)

    min_P_to_Q = dist.min(dim=1)[0]
    min_Q_to_P = dist.min(dim=0)[0]

    # Apply weights to boundary points
    weights_P = torch.ones_like(min_P_to_Q)
    weights_P[edge_mask_flat] *= edge_weight

    weights_Q = torch.ones_like(min_Q_to_P)
    weights_Q[edge_mask_flat] *= edge_weight

    loss = (min_P_to_Q * weights_P).mean() + (min_Q_to_P * weights_Q).mean()

    # Reshape aligned prediction back for visualization
    prediction_aligned_grid = P_aligned.T.reshape(1, 3, H, W)

    return loss, prediction_aligned_grid


def rough_align(P, Q):
    """
    Roughly aligns P to Q by:
    - Matching centers
    - Building orientation from P only
    - Reusing orientation for Q (so identical clouds don’t get rotated)
    """

    # print("\n--- Rough Farthest-Edge Align (Safe) Debug ---")

    # 1. Compute centers
    P_center = P.mean(0, keepdim=True)
    Q_center = Q.mean(0, keepdim=True)
    # P_centered = P - P_center
    # Q_centered = Q - Q_center
    P_centered = P 
    Q_centered = Q 

    # 2. Use farthest point pair on P to define primary axis
    diffP = P_centered.unsqueeze(1) - P_centered.unsqueeze(0)
    distP = torch.sum(diffP ** 2, dim=2)
    iP, jP = torch.nonzero(distP == distP.max(), as_tuple=True)
    idxP1, idxP2 = iP[0].item(), jP[0].item()

    xP = (P_centered[idxP2] - P_centered[idxP1])
    xP = xP / torch.norm(xP)

    # 3. Secondary axis from P
    maskP = torch.ones(len(P_centered), dtype=torch.bool)
    maskP[[idxP1, idxP2]] = False
    subP = P_centered[maskP]
    diffP2 = subP.unsqueeze(1) - subP.unsqueeze(0)
    distP2 = torch.sum(diffP2 ** 2, dim=2)
    iP2, jP2 = torch.nonzero(distP2 == distP2.max(), as_tuple=True)
    idxP3, idxP4 = iP2[0].item(), jP2[0].item()
    yP_raw = subP[idxP4] - subP[idxP3]

    yP = yP_raw - torch.dot(yP_raw, xP) * xP
    yP = yP / torch.norm(yP)

    # 4. Build right-handed frame from P
    zP = torch.cross(xP, yP)
    frame_P = torch.stack([xP, yP, zP], dim=1)

    # ✅ Use the SAME frame for Q (no recalculation)
    frame_Q = frame_P.clone()

    # print("Frame P:\n", frame_P)
    # print("Frame Q (reused):\n", frame_Q)

    # 5. Rotation (now guaranteed identity if geometry is identical)
    R = frame_Q @ frame_P.T
    # print("Rotation matrix R:\n", R)
    # print("det(R):", torch.det(R).item())

    # 6. Translation
    t = Q_center - P_center @ R
    # print("Translation vector t:", t.tolist())

    # 7. Apply
    P_aligned = P @ R + t

    return P_aligned

def pointlist3d_to_tensor_grid(pointlist3d, x, y):
    """
    Converts a Point3d list into a (1, 3, x, y) tensor.
    Assumes point list is ordered row-major or column-major to match the grid.
    """
    coords = [[pt.X, pt.Y, pt.Z] for pt in pointlist3d]
    tensor = torch.tensor(coords, dtype=torch.float32)   # (N, 3)
    tensor = tensor.T.reshape(1, 3, y, x)  # now matches model output shape
    return tensor

def register_pointclouds_gh(P_list, Q_list, distance_threshold=0.01):
    """
    Aligns point cloud P onto Q using:
      1. Center translation
      2. Fast Global Registration
      3. ICP refinement

    Inputs:
        P_list: list of rg.Point3d (source)
        Q_list: list of rg.Point3d (target)
        distance_threshold: ICP max correspondence distance

    Outputs:
        aligned_points: list of rg.Point3d (P aligned to Q)
        final_transformation: 4x4 numpy array
    """

    print("\n--- GH Registration Debug ---")

    # --- 1. Convert GH points to numpy arrays ---
    P_np = np.array([[pt.X, pt.Y, pt.Z] for pt in P_list], dtype=np.float64)
    Q_np = np.array([[pt.X, pt.Y, pt.Z] for pt in Q_list], dtype=np.float64)

    # --- 2. Compute centers ---
    P_center = P_np.mean(axis=0)
    Q_center = Q_np.mean(axis=0)
    print("P center:", P_center, "Q center:", Q_center)

    P_centered = P_np - P_center
    Q_centered = Q_np - Q_center

    # --- 3. Build Open3D point clouds ---
    pcd_P = o3d.geometry.PointCloud()
    pcd_Q = o3d.geometry.PointCloud()
    pcd_P.points = o3d.utility.Vector3dVector(P_centered)
    pcd_Q.points = o3d.utility.Vector3dVector(Q_centered)

    # --- 4. Estimate normals (for registration) ---
    pcd_P.estimate_normals(o3d.geometry.KDTreeSearchParamHybrid(radius=0.1, max_nn=30))
    pcd_Q.estimate_normals(o3d.geometry.KDTreeSearchParamHybrid(radius=0.1, max_nn=30))

    # --- 5. Compute FPFH features for Fast Global Registration ---
    radius_feature = 0.25
    pcd_P_fpfh = o3d.pipelines.registration.compute_fpfh_feature(
        pcd_P, o3d.geometry.KDTreeSearchParamHybrid(radius=radius_feature, max_nn=100)
    )
    pcd_Q_fpfh = o3d.pipelines.registration.compute_fpfh_feature(
        pcd_Q, o3d.geometry.KDTreeSearchParamHybrid(radius=radius_feature, max_nn=100)
    )

    # --- 6. Fast Global Registration ---
    fgr_result = o3d.pipelines.registration.registration_fgr_based_on_feature_matching(
        pcd_P, pcd_Q, pcd_P_fpfh, pcd_Q_fpfh,
        o3d.pipelines.registration.FastGlobalRegistrationOption(
            maximum_correspondence_distance=distance_threshold
        )
    )
    print("FGR transformation:\n", fgr_result.transformation)

    # --- 7. ICP refinement ---
    icp_result = o3d.pipelines.registration.registration_icp(
        pcd_P, pcd_Q, distance_threshold,
        fgr_result.transformation,
        o3d.pipelines.registration.TransformationEstimationPointToPlane()
    )
    print("ICP refined transformation:\n", icp_result.transformation)

    # --- 8. Apply final transformation ---
    P_registered = np.asarray(pcd_P.points)
    P_registered_h = np.hstack((P_registered, np.ones((P_registered.shape[0], 1))))  # (N,4)
    P_transformed = (icp_result.transformation @ P_registered_h.T).T[:, :3]

    # --- 9. Add back Q’s center (since we centered earlier) ---
    P_aligned = P_transformed + Q_center

    # --- 10. Convert back to GH Point3d ---
    aligned_points = [rg.Point3d(float(x), float(y), float(z)) for x, y, z in P_aligned]

    return aligned_points, icp_result.transformation


def one_time_open3d_align(predicted, target):
    """
    Runs Open3D once to coarsely align target to predicted.
    Returns: transformed_target (torch.Tensor, same shape as target)
    """
    # Flatten from (1, 3, x, y) -> (N, 3)
    P = predicted.permute(0, 2, 3, 1).reshape(-1, 3).detach().cpu().numpy()
    Q = target.permute(0, 2, 3, 1).reshape(-1, 3).detach().cpu().numpy()

    # Convert to GH Point3d for the existing registration function
    P_points = [rg.Point3d(float(x), float(y), float(z)) for x, y, z in P]
    Q_points = [rg.Point3d(float(x), float(y), float(z)) for x, y, z in Q]

    aligned_points, transform = register_pointclouds_gh(P_points, Q_points)

    # Convert aligned target back to Torch tensor
    Q_aligned_np = np.array([[pt.X, pt.Y, pt.Z] for pt in aligned_points], dtype=np.float32)
    Q_aligned = torch.tensor(Q_aligned_np, dtype=target.dtype, device=target.device)

    # Reshape back to (1, 3, y, x)
    y_dim, x_dim = target.shape[2], target.shape[3]
    Q_aligned_grid = Q_aligned.T.reshape(1, 3, y_dim, x_dim)

    return Q_aligned_grid


def torch_icp(P, Q, iters=3, blend=0.2):
    """
    Differentiable ICP with controllable step size.
    blend: 0-1, fraction of ICP transform to apply each iteration.
    """
    R_total = torch.eye(3, device=P.device, dtype=P.dtype)
    t_total = torch.zeros(1, 3, device=P.device, dtype=P.dtype)

    P_aligned = P

    for i in range(iters):
        # Find correspondences
        diff = P_aligned.unsqueeze(1) - Q.unsqueeze(0)
        dist = (diff**2).sum(dim=2)
        idx = dist.argmin(dim=1)
        Q_matched = Q[idx]

        # Centroids
        P_mean = P_aligned.mean(0, keepdim=True)
        Q_mean = Q_matched.mean(0, keepdim=True)

        # Solve for R, t
        P_centered = P_aligned - P_mean
        Q_centered = Q_matched - Q_mean
        H = P_centered.T @ Q_centered
        U, S, Vt = torch.linalg.svd(H)
        R = Vt.T @ U.T
        if torch.det(R) < 0:
            Vt[-1, :] *= -1
            R = Vt.T @ U.T
        t = Q_mean - P_mean @ R

        # ✅ Blended update
        R_step = (1-blend) * torch.eye(3, device=P.device) + blend * R
        t_step = blend * t

        # Apply the “partial” transform
        P_aligned = P_aligned @ R_step + t_step

        # Accumulate transform
        R_total = R_step @ R_total
        t_total = (t_step @ R_total) + t_total

    return P_aligned, R_total, t_total

def wrap_angles_to_180(angles):
    angles_mod = torch.remainder(angles, 360.0)
    wrapped = torch.where(angles_mod > 180.0, 360.0 - angles_mod, angles_mod)
    return wrapped


def lhs_generate_candidates(num_candidates, num_angles):
    """
    Generate candidate angle sets in [0,180] using Latin Hypercube Sampling.
    """
    sampler = qmc.LatinHypercube(d=num_angles)
    samples = sampler.random(num_candidates)  # values in [0,1]
    angles = torch.tensor(samples * 180.0, dtype=torch.float32)
    return angles

def evaluate_candidates(angles_candidates, model, target_normalized):
    """
    Evaluate each LHS candidate by computing the loss through the model.
    Return the best angle set and its loss.
    """
    best_loss = float("inf")
    best_angles = None

    for i in range(angles_candidates.shape[0]):
        candidate = angles_candidates[i]

        # Prepare input grid
        candidate_grid = duplicate_pixel_data_torch(
            candidate,
            x_cm=x_cm,
            y_cm=y_cm,
            patch_x=patch_x,
            patch_y=patch_y,
            fortran_order=True
        )

        # Forward pass
        prediction = model(candidate_grid / 180.0)

        # Compute loss
        # loss, _ = chamfer_loss_with_registration(prediction, target_normalized)
        loss, _ = chamfer_loss_weighted_edges(prediction, target_normalized)
        loss = loss * 100
        loss_val = loss.item()

        if loss_val < best_loss:
            best_loss = loss_val
            best_angles = candidate.clone()

    return best_angles, best_loss


def tensors_to_pointlists(prediction, target):
    """
    Convert model prediction and target (shape: (1, 3, y, x)) into
    two flat lists of Rhino Point3d for Grasshopper visualization.

    Args:
        prediction: torch.Tensor of shape (1, 3, y, x)
        target: torch.Tensor of shape (1, 3, y, x)

    Returns:
        pred_points (list[rg.Point3d]), target_points (list[rg.Point3d])
    """
    # Move to CPU and remove batch dim
    pred_np = prediction.detach().cpu().numpy().squeeze()   # (3, y, x)
    target_np = target.detach().cpu().numpy().squeeze()     # (3, y, x)

    y_dim, x_dim = pred_np.shape[1], pred_np.shape[2]
    pred_points, target_points = [], []

    for i in range(y_dim):
        for j in range(x_dim):
            # predicted point
            px, py, pz = pred_np[:, i, j]
            pred_points.append(rg.Point3d(float(px), float(py), float(pz)))

            # target point
            tx, ty, tz = target_np[:, i, j]
            target_points.append(rg.Point3d(float(tx), float(ty), float(tz)))

    return pred_points, target_points
# ┌───────────────────────────────────────────────────────────────────────────┐
# │                             Model Class                                   │
# └───────────────────────────────────────────────────────────────────────────┘

class OurVgg16InstanceNorm2d24lay(torch.nn.Module):
    def __init__(self, dropout=0.3):
        super().__init__()
        self.features = torch.nn.Sequential(
            # Stage 1
            self.block(features_channels, 64),
            self.block(64, 64),
            self.block(64, 64),
            self.block(64, 64, dropout),

            # Stage 2
            self.block(64, 128),
            self.block(128, 128),
            self.block(128, 128),
            self.block(128, 128, dropout),

            # Stage 3
            self.block(128, 256),
            self.block(256, 256),
            self.block(256, 256),
            self.block(256, 256, dropout),

            # Stage 4
            self.block(256, 512),
            self.block(512, 512),
            self.block(512, 512),
            self.block(512, 512, dropout),

            # Stage 5
            self.block(512, 768),
            self.block(768, 768),
            self.block(768, 768),
            self.block(768, 768, dropout),

            # Stage 6
            self.block(768, 1024),
            self.block(1024, 1024),
            self.block(1024, 1024),
            self.block(1024, 1024, dropout),
        )
        self.output_conv = torch.nn.Conv2d(1024, labels_channels, 3, padding=1)
        self.sigmoid = torch.nn.Sigmoid()

    def block(self, in_ch, out_ch, apply_dropout=False):
        layers = [
            torch.nn.Conv2d(in_ch, out_ch, kernel_size=3, padding=1),
            torch.nn.InstanceNorm2d(out_ch),
            torch.nn.ReLU()
        ]
        if apply_dropout:
            layers.append(torch.nn.Dropout())
        return torch.nn.Sequential(*layers)

    def forward(self, x):
        x = self.features(x)
        x = self.output_conv(x)
        x = self.sigmoid(x)
        return x
# ┌───────────────────────────────────────────────────────────────────────────┐
# │                        Main Code - Optimization                           │
# └───────────────────────────────────────────────────────────────────────────┘

gh_has_run = False

torch.manual_seed(42)
import random, numpy as np
random.seed(42)
np.random.seed(42)


# Make sure component only runs once
if gh_has_run == False:
    print("✅ First run – running optimization loop")
    gh_has_run = True



    device = torch.device("cuda" if torch.cuda.is_available() else "cpu")
    print(f"Using device: {device}")

    # 🚀 1. Initialize wandb run
    os.environ["WANDB_MODE"] = "disabled" # Disable wandb
    os.environ["WANDB_DIR"] = os.path.expanduser("~/wandb")
    wandb.init(
        project="GH-optimization",
        dir=os.environ["WANDB_DIR"],
        config={
            "step_num": step_num,
            "registration_type": "basic",   # or "open3d" etc.
        }
    )




    # Define the Model
    t0 = time.time()
    model = OurVgg16InstanceNorm2d24lay()
    model.load_state_dict(torch.load(model_path, map_location=device))
    model.eval()  # ensure correct evaluation mode
    model.to(device)
    print("Model init time:", time.time() - t0, "seconds")


    # Convert target to tensor
    target = pointlist3d_to_tensor_grid(target, x=x_cm, y=y_cm)

    # Normalize the target
    labels_max_tensor = torch.tensor(labels_max, dtype=torch.float32).view(1, -1, 1, 1)
    labels_min_tensor = torch.tensor(labels_min, dtype=torch.float32).view(1, -1, 1, 1)

    target_normalized = (target - labels_min_tensor) / (labels_max_tensor - labels_min_tensor + 1e-8)
    target_normalized = target_normalized.to(device)

    print(target.shape)
    print(target_normalized)


    # Step 3: Model inference
    start_time = time.time()


    # 1. Initialize angles 
    num_angles = int((x_cm / patch_x) * (y_cm / patch_y))

    #LHS
    # Step 1: Generate candidates
    num_candidates = 5000
    angles_candidates = lhs_generate_candidates(num_candidates, num_angles).to(device)

    # Step 2: Evaluate candidates
    print("Evaluating LHS candidates...")
    best_angles, best_loss = evaluate_candidates(angles_candidates, model, target_normalized)

    print(f"✅ Best candidate found with loss={best_loss:.6f}")
    # Step 3: Use best_angles to initialize optimizer
    angles = torch.nn.Parameter(best_angles, requires_grad=True)

    #  Initiate with "initial_angles"
    # initial_angles_tensor = torch.tensor(initial_angles, dtype=torch.float32, device=device)
    # angles = torch.nn.Parameter(initial_angles_tensor)

    # # all 90
    # angles = torch.nn.Parameter(torch.full((num_angles,), 90.0, dtype=torch.float32, device=device))


    # 🔹 Run Open3D once
    angles_grid_temp = duplicate_pixel_data_torch(angles, 
                                        x_cm=x_cm, 
                                        y_cm=y_cm, 
                                        patch_x=patch_x, 
                                        patch_y=patch_y, 
                                        fortran_order=True).to(device)

    prediction = model(angles_grid_temp/180.0) 
    target_aligned = one_time_open3d_align(prediction, target_normalized)

    print("✅ Target point cloud aligned once with Open3D")

    # Init prediction_alinged so it's not local 
    prediction_aligned = None

    # Stage 1: Adam exploration
    pre_lr = 0.01
    best_loss = 1000
    optimizer = torch.optim.Adam([angles], lr=pre_lr, amsgrad=True)
    wandb.config.update({"pre optimizer": optimizer.__class__.__name__, "pre lr": pre_lr}, allow_val_change=True)
    for step in range(step_num):
        optimizer.zero_grad()
        wrapped_angles = wrap_angles_to_180(angles)

        prediction = model(duplicate_pixel_data_torch(
                                                    wrapped_angles,
                                                    x_cm=x_cm,
                                                    y_cm=y_cm,
                                                    patch_x=patch_x,
                                                    patch_y=patch_y,
                                                    fortran_order=True) / 180.0)

        # loss, prediction_aligned = chamfer_loss_with_registration(prediction, target_normalized)
        loss, prediction_aligned = chamfer_loss_weighted_edges(prediction, target_normalized)

        loss = loss * 100
        loss.backward()
        optimizer.step()

        # Track best result
        if loss.item() < best_loss:
            best_loss = loss.item()
            best_angles = angles.clone()
            best_prediction = prediction_aligned
            
        if step % 100 == 0:
            print(f"Adam step: {step}, loss: {loss}")
    print(f"loss after Adam: {best_loss}")


    # 2. Set up main optimizer
    lr = 0.001
    momentum = 0.9
    max_iter = 20
    history_size = 10

    optimizer = torch.optim.LBFGS([angles], lr=lr, max_iter=max_iter, history_size=history_size)


    # 🔢 store optimizer info in wandb
    wandb.config.update({"optimizer": optimizer.__class__.__name__, "momentum": momentum, "lr": lr, "history size optimizer": history_size, "max iter optimizer": max_iter}, allow_val_change=True)
    
    
    # # # 4. Optimization loop
    # for step in range(step_num):
    #     # 🔹 LBFGS requires a closure it can call many times internally
    #     def closure():
    #         optimizer.zero_grad()
            
    #         # Build input grid
    #         angles_grid = duplicate_pixel_data_torch(
    #             angles,
    #             x_cm=x_cm,
    #             y_cm=y_cm,
    #             patch_x=patch_x,
    #             patch_y=patch_y,
    #             fortran_order=True
    #         )
    #         normalized_tensor = angles_grid / 180.0

    #         # Forward + loss
    #         prediction = model(normalized_tensor)

    #         # loss, _ = chamfer_loss_with_registration(prediction, target_normalized)
    #         loss, _ = chamfer_loss_weighted_edges(prediction, target_normalized)
            
    #         loss = loss * 100

    #         loss.backward()

    #         with torch.no_grad():
    #             angles.clamp_(0.0, 180.0)

    #         return loss

    #     # ✅ LBFGS step (closure will be called many times internally)
    #     final_loss = optimizer.step(closure)

    #     # # ✅ Clamp angles after step
    #     # with torch.no_grad():
    #     #     angles.clamp_(0.0, 180.0)

    #     # 🔁 Recompute prediction ONCE per step (final output after LBFGS step)
    #     angles_grid = duplicate_pixel_data_torch(
    #         angles,
    #         x_cm=x_cm,
    #         y_cm=y_cm,
    #         patch_x=patch_x,
    #         patch_y=patch_y,
    #         fortran_order=True
    #     )
    #     prediction = model(angles_grid / 180.0)
    #     # loss, prediction_aligned = chamfer_loss_with_registration(prediction, target_normalized)
    #     loss, prediction_aligned = chamfer_loss_weighted_edges(prediction, target_normalized)
        
    #     loss = loss * 100

    #     # 📊 Print/log only ONCE per step
    #     if step % 50 == 0:
    #         print(f"Step {step}: loss={loss.item():.6f}")
    #     wandb.log({"step": step, "loss": loss.item()})


    # 3. Preview
    scale_factor = 100.0  
    prediction_aligned = best_prediction

    prediction_aligned = prediction_aligned.float() * scale_factor
    target_normalized = target_normalized.float() * scale_factor
    pred_prev, target_prev = tensors_to_pointlists(prediction_aligned, target_normalized)


    end_time = time.time()

    angles = best_angles
    optimized_angles = angles.detach().cpu().numpy()  # convert to numpy
    print(f"optimized angles: {optimized_angles}")


    print(f"Optimization time: {end_time - start_time:.4f} seconds")

    # 🔚 Log final results
    wandb.log({"final_loss": loss.item(), "total_time_sec": end_time - start_time, "angles":optimized_angles})

    wandb.finish()

    # ✅ Wrap angles so they are in [0,180]
    final_angles = wrap_angles_to_180(angles)

    # ✅ Round to nearest int
    rounded_angles = torch.round(final_angles).to(torch.int)

    # ✅ Convert to Python list for Grasshopper
    angles_out = rounded_angles.cpu().numpy().tolist()


else:
    print("♻️ GH re-ran component but skipping loop")
# ---------- end forward_optimization_xyz ----------

# ----
optimized_python_component = Number(forward_optimization_xyz.angles_out)
optimized_pycharm = Relay()  # disabled
patch_predictions = Integer(optimized_python_component)

number_slider_24 = Slider(10, range=0..10)
hatch = ModelHatch(
    Boundary=recgrid.Cells,
    HatchPattern=<geometry referenced from the Rhino model>,
    Rotation=patch_predictions,
    Scale=Slider(5, range=0..100),
    ShowBoundary=True)  # -> Hatch, Boundary, Plane, HatchPattern, BasePoint, Rotation, Scale, ShowBoundary, Background, FillStyle
preview_8 = CustomPreview(Geometry=hatch.Hatch, Material=ColourSwatch(SwatchColor=RGB(0, 0, 0)))

# ---- group: Visualization Per Patch(Average)
gradient_3 = Gradient(
    LowerLimit=0,
    UpperLimit=180,
    Parameter=patch_predictions,
    stops=[0: RGB(243, 57, 0), 0.1: RGB(236, 27, 60), 0.2: RGB(210, 0, 118), 0.3: RGB(103, 0, 120), 0.4: RGB(39, 72, 161), 0.5: RGB(1, 192, 229), 0.6: RGB(18, 178, 90), 0.7: RGB(79, 186, 8), 0.8: RGB(220, 237, 32), 0.9: RGB(247, 159, 20), 1: RGB(243, 57, 0)])
srf_5 = Surface(recgrid.Cells)
preview_9 = CustomPreview(Geometry=srf_5, Material=gradient_3)
tag_3 = TextTag(Location=area_2.Centroid, Text=patch_predictions, Colour=swatch_2)

# ----
# 5. Simulation
simulation = Simulation(num=roundf_2.Rounded, num_2=roundf.Rounded, B_2=patch_size, B=patch_size, connect_angles=patch_predictions)  # -> L, number_slider_6, number_slider_7
srf_6 = Surface(simulation.L)  # disabled

# ---- group: Heydat (continued)
transform = Transform(Geometry=srf_6, Transform=inverse)  # disabled

# ---- group: Heydat / Loop (continued)
bake_attr = BakeAttributes(Geometry=transform, Bake=toggle)  # disabled
data_2 = Data(bake_attr)  # disabled
loop_end = LoopEnd(port=loop_start.port, Exit=toggle_2, Data=data_2, TimeOutVal=0, pausedState=False, state="Constant output")  # disabled

# ---- group: Get differences
number_slider_25 = Slider(0, range=0..100)
vec_2 = VectorXYZ(XComponent=number_slider_25, YComponent=number_slider_25, ZComponent=0)  # -> Vector, Length
area_4 = Area(Geometry=move.Geometry)  # -> Area, Centroid
# 6. Analyse Results
move_3 = Move(Geometry=simulation.L, Motion=vec_2.Vector)  # -> Geometry, Transform
area_5 = Area(Geometry=move_3.Geometry)  # -> Area, Centroid
orient_4 = Orient(Geometry=move_3.Geometry, Source=area_5.Centroid, Target=area_4.Centroid)  # -> Geometry, Transform
sdivide_5 = DivideSurface(Surface=orient_4.Geometry, UCount=roundf_2.Rounded, VCount=roundf.Rounded)  # -> Points, Normals, Parameters
ptcell_3 = Cellulate(Grid=sdivide_5.Points)  # -> Wires, Cells, Meshes
mesh = Mesh(ptcell_2.Meshes)
area_6 = MeshArea(Mesh=ptcell_3.Meshes)  # -> Area, Centroid
area_7 = MeshArea(Mesh=mesh)  # -> Area, Centroid
dist_3 = Distance(PointA=area_7.Centroid, PointB=flatten(area_6.Centroid))

# ----
gradient_4 = Gradient(
    LowerLimit=Slider(0, range=0..100),
    UpperLimit=Slider(1, range=0..100),
    Parameter=dist_3,
    stops=[0: RGB(0, 128, 0), 0.5: RGB(255, 255, 0), 1: RGB(255, 0, 0)])
preview_10 = CustomPreview(Geometry=flatten(ptcell_3.Meshes), Material=flatten(gradient_4))

avr_4 = Average(Input=dist_3)
panel_15 = Panel(avr_4)

# ---- group: Optimizer
swatch_9 = ColourSwatch(SwatchColor=RGBA(25, 0, 255, 115))
pt_3 = Point(forward_optimization_xyz.target_prev)
pt_4 = Point(forward_optimization_xyz.pred_prev)
preview_11 = CustomPreview(Geometry=pt_4, Material=swatch_9)
preview_12 = CustomPreview(Geometry=pt_3, Material=ColourSwatch(SwatchColor=RGBA(255, 0, 0, 114)))

# ----
panel_16 = Panel(forward_optimization_xyz.out)

# ---- group: Preview
vec_3 = VectorXYZ(XComponent=Slider(-50, range=-100..100), YComponent=0, ZComponent=0)  # -> Vector, Length
move_4 = Move(Geometry=srf_5, Motion=vec_3.Vector)  # -> Geometry, Transform
move_5 = Move(Geometry=area_2.Centroid, Motion=vec_3.Vector)  # -> Geometry, Transform
preview_13 = CustomPreview(Geometry=move_4.Geometry, Material=gradient_3)
tag_4 = TextTag(Location=move_5.Geometry, Text=patch_predictions, Colour=swatch_2)

# ---- group: Gene Pool
multiplication_8 = Multiplication(A=roundf_2.Rounded, B=roundf.Rounded)
sqr = Square(Value=patch_size)
division_3 = Division(A=multiplication_8, B=sqr)
genes = GenePool(Decimals=0, Maximum=180, Minimum=1, Value=[49, 47, 86, 53, 36, 160, 90.5, 90.5, 90.5])
pool_controller = GenePoolController(GenePool=genes, Count=division_3, Randomness=0.1)
galapagos = Galapagos(fitness=avr_6, gene=genes)

# ---- group: Preview (continued)
phatch = PatternHatch(Boundaries=graft(move_4.Geometry), Pattern=1, Scale=Slider(10, range=1..10), Angle=graft(degrees(genes)))

# ----
forward_prediction_xyz = Python3Script(
    labels_max=max,
    labels_min=min,
    x_cm=roundf_2.Rounded,
    y_cm=roundf.Rounded,
    patch_x=patch_size,
    patch_y=patch_size,
    n_of_features_channels=number_slider_21,
    n_of_labels_channels=number_slider_20,
    model_path=model_path_24_layers,
    angles=genes)  # -> out, predicted_out_spatial; inputs labels_max: list of Double, labels_min: list of Double, x_cm: Int32, y_cm: Int32, patch_x: Int32, patch_y: Int32, n_of_features_channels: Int32, n_of_labels_channels: Int32, angles: list of Double; disabled
# ---------- forward_prediction_xyz: Python ----------
# ┌───────────────────────────────────────────────────────────────────────────┐
# │                      Imports and Definitions                              │
# └───────────────────────────────────────────────────────────────────────────┘
# venv: forward_prediction_XYZ
# r: numpy, torch, matplotlib, pathlib


import numpy as np
import torch 
import torch.nn as nn
from torch.optim.lr_scheduler import ReduceLROnPlateau
from Grasshopper import DataTree
from Grasshopper.Kernel.Data import GH_Path
import matplotlib
import matplotlib.pyplot as plt
matplotlib.use('Agg')  # Use a non-interactive backend
from pathlib import Path
import torch.nn.functional as F

features_channels = n_of_labels_channels 
labels_channels =  n_of_features_channels 



# ┌───────────────────────────────────────────────────────────────────────────┐
# │                               Functions                                   │
# └───────────────────────────────────────────────────────────────────────────┘

def duplicate_pixel_data(input_data, x_cm, y_cm, patch_x, patch_y, fortran_order=False):
    """
    Duplicates coarse grid values into patches in a larger tensor.
    
    Args:
        input_data (list, np.ndarray, or torch.Tensor): Either flat or 2D grid of values.
        x_cm (int): Width of output grid.
        y_cm (int): Height of output grid.
        patch_x (int): Width of each patch.
        patch_y (int): Height of each patch.
        fortran_order (bool): Whether to interpret flat input in column-major (Fortran) order.

    Returns:
        torch.Tensor: 4D tensor of shape (1, 1, y_cm, x_cm) with duplicated values.
    """
    num_patches_y = y_cm // patch_y
    num_patches_x = x_cm // patch_x
    expected_size = num_patches_y * num_patches_x

    # Convert input to torch tensor
    if isinstance(input_data, torch.Tensor):
        tensor_input = input_data
    elif isinstance(input_data, np.ndarray):
        tensor_input = torch.tensor(input_data, dtype=torch.float32)
    elif isinstance(input_data, list):
        tensor_input = torch.tensor(input_data, dtype=torch.float32)
    else:
        raise TypeError("Unsupported input type")

    # Handle flat input: reshape into 2D grid
    if tensor_input.dim() == 1:
        assert tensor_input.numel() == expected_size, f"Expected {expected_size} values, got {tensor_input.numel()}"
        if fortran_order:
            np_input = tensor_input.numpy().reshape((num_patches_y, num_patches_x), order='F')
            tensor_input = torch.tensor(np_input, dtype=torch.float32)
        else:
            tensor_input = tensor_input.view(num_patches_y, num_patches_x)

    final_tensor = torch.zeros((1, 1, y_cm, x_cm), dtype=torch.float32)

    for i in range(num_patches_y):
        for j in range(num_patches_x):
            row_start = i * patch_y
            row_end = row_start + patch_y
            col_start = j * patch_x
            col_end = col_start + patch_x
            final_tensor[:, 0, row_start:row_end, col_start:col_end] = tensor_input[i, j]


    return final_tensor

def tensor_to_tree(tensor):
    """
    Converts a [1, C, H, W] tensor into a DataTree[float] with each channel as a branch,
    """
    tree = DataTree[float]()
    tensor = tensor.detach().squeeze(0)  # shape: [C, H, W]
    C = tensor.shape[0]
    H = tensor.shape[1]
    W = tensor.shape[2]
    print(f"tensor shape before conversion to tree: {C}, {H}, {W}")

    for ch in range(C):
        path = GH_Path(ch)
        for y in range(H):
            for x in range(W):
                tree.Add(float(tensor[ch, y, x]), path)

    return tree

def tensor_to_spatial_tree(tensor):
    """
    Converts a [1, C, H, W] tensor into a DataTree[float] with each {h,w} as a branch
    containing C channel values.
    """
    tree = DataTree[float]()
    tensor = tensor.detach().squeeze(0)  # shape: [C, H, W]
    C, H, W = tensor.shape
    print(f"tensor shape before conversion: {C}, {H}, {W}")

    for y in range(H):
        for x in range(W):
            path = GH_Path(y, x)
            for ch in range(C):
                tree.Add(float(tensor[ch, y, x]), path)

    return tree

def pad_tensor(max_h,max_w,tensor):

    """
    Pads a tensor of shape [1, C, H, W] to [1, C, 40, 40] using zero-padding.
    """
    _, _, h, w = tensor.shape
    pad_h = max_h - h
    pad_w = max_w - w
    return F.pad(tensor, (0, pad_w, 0, pad_h), mode='constant', value=0)


# ┌───────────────────────────────────────────────────────────────────────────┐
# │                             Model Class                                   │
# └───────────────────────────────────────────────────────────────────────────┘

class OurVgg16InstanceNorm2d(torch.nn.Module):
    """
    Custom VGG-style model with conv-only architecture, no fully connected layers.
    Outputs a single-channel prediction (e.g., fiber orientation).
    """
    def __init__(self, dropout=0.3):
        super(OurVgg16InstanceNorm2d, self).__init__()

        self.conv_1 = torch.nn.Conv2d(in_channels=features_channels, out_channels=64, kernel_size=3, padding=1)
        self.conv_2 = torch.nn.Conv2d(in_channels=64, out_channels=128, kernel_size=3, padding=1)
        self.conv_3 = torch.nn.Conv2d(in_channels=128, out_channels=128, kernel_size=3, padding=1)
        self.conv_4 = torch.nn.Conv2d(in_channels=128, out_channels=256, kernel_size=3, padding=1)
        self.conv_5 = torch.nn.Conv2d(in_channels=256, out_channels=256, kernel_size=3, padding=1)
        self.conv_6 = torch.nn.Conv2d(in_channels=256, out_channels=512, kernel_size=3, padding=1)
        self.conv_7 = torch.nn.Conv2d(in_channels=512, out_channels=512, kernel_size=3, padding=1)
        self.conv_8 = torch.nn.Conv2d(in_channels=512, out_channels=512, kernel_size=3, padding=1)
        self.conv_9 = torch.nn.Conv2d(in_channels=512, out_channels=512, kernel_size=3, padding=1)
        self.conv_10 = torch.nn.Conv2d(in_channels=512, out_channels=256, kernel_size=3, padding=1)
        self.conv_11 = torch.nn.Conv2d(in_channels=256, out_channels=256, kernel_size=3, padding=1)
        self.conv_12 = torch.nn.Conv2d(in_channels=256, out_channels=128, kernel_size=3, padding=1)
        self.conv_13 = torch.nn.Conv2d(in_channels=128, out_channels=128, kernel_size=3, padding=1)
        self.conv_14 = torch.nn.Conv2d(in_channels=128, out_channels=labels_channels, kernel_size=3, padding=1)  # final output

        self.instance_norm_1 = torch.nn.InstanceNorm2d(64)
        self.instance_norm_2 = torch.nn.InstanceNorm2d(128)
        self.instance_norm_3 = torch.nn.InstanceNorm2d(128)
        self.instance_norm_4 = torch.nn.InstanceNorm2d(256)
        self.instance_norm_5 = torch.nn.InstanceNorm2d(256)
        self.instance_norm_6 = torch.nn.InstanceNorm2d(512)
        self.instance_norm_7 = torch.nn.InstanceNorm2d(512)
        self.instance_norm_8 = torch.nn.InstanceNorm2d(512)
        self.instance_norm_9 = torch.nn.InstanceNorm2d(512)
        self.instance_norm_10 = torch.nn.InstanceNorm2d(256)
        self.instance_norm_11 = torch.nn.InstanceNorm2d(256)
        self.instance_norm_12 = torch.nn.InstanceNorm2d(128)
        self.instance_norm_13 = torch.nn.InstanceNorm2d(128)


        self.relu = torch.nn.ReLU()
        self.dropout = torch.nn.Dropout(p=dropout)
        self.sigmoid = torch.nn.Sigmoid()

    def forward(self, x):
        x = self.conv_1(x); x = self.instance_norm_1(x); x = self.relu(x)
        x = self.conv_2(x); x = self.instance_norm_2(x); x = self.relu(x)
        x = self.dropout(x);
        x = self.conv_3(x); x = self.instance_norm_3(x); x = self.relu(x)
        x = self.conv_4(x); x = self.instance_norm_4(x); x = self.relu(x)
        x = self.dropout(x);
        x = self.conv_5(x); x = self.instance_norm_5(x); x = self.relu(x)
        x = self.conv_6(x); x = self.instance_norm_6(x); x = self.relu(x)
        x = self.dropout(x);
        x = self.conv_7(x); x = self.instance_norm_7(x); x = self.relu(x)
        x = self.conv_8(x); x = self.instance_norm_8(x); x = self.relu(x)
        x = self.dropout(x);
        x = self.conv_9(x); x = self.instance_norm_9(x); x = self.relu(x)
        x = self.conv_10(x); x = self.instance_norm_10(x); x = self.relu(x)
        x = self.dropout(x);
        x = self.conv_11(x); x = self.instance_norm_11(x); x = self.relu(x)
        x = self.conv_12(x); x = self.instance_norm_12(x); x = self.relu(x)
        x = self.dropout(x);
        x = self.conv_13(x); x = self.instance_norm_13(x); x = self.relu(x)
        x = self.conv_14(x);
        x = self.sigmoid(x)
        # x = torch.clamp(x, 0.0, 1.0)
        return x

class OurVgg16InstanceNorm2d24lay(torch.nn.Module):
    def __init__(self, dropout=0.3):
        super().__init__()
        self.features = torch.nn.Sequential(
            # Stage 1
            self.block(features_channels, 64),
            self.block(64, 64),
            self.block(64, 64),
            self.block(64, 64, dropout),

            # Stage 2
            self.block(64, 128),
            self.block(128, 128),
            self.block(128, 128),
            self.block(128, 128, dropout),

            # Stage 3
            self.block(128, 256),
            self.block(256, 256),
            self.block(256, 256),
            self.block(256, 256, dropout),

            # Stage 4
            self.block(256, 512),
            self.block(512, 512),
            self.block(512, 512),
            self.block(512, 512, dropout),

            # Stage 5
            self.block(512, 768),
            self.block(768, 768),
            self.block(768, 768),
            self.block(768, 768, dropout),

            # Stage 6
            self.block(768, 1024),
            self.block(1024, 1024),
            self.block(1024, 1024),
            self.block(1024, 1024, dropout),
        )
        self.output_conv = torch.nn.Conv2d(1024, labels_channels, 3, padding=1)
        self.sigmoid = torch.nn.Sigmoid()

    def block(self, in_ch, out_ch, apply_dropout=False):
        layers = [
            torch.nn.Conv2d(in_ch, out_ch, kernel_size=3, padding=1),
            torch.nn.InstanceNorm2d(out_ch),
            torch.nn.ReLU()
        ]
        if apply_dropout:
            layers.append(torch.nn.Dropout())
        return torch.nn.Sequential(*layers)

    def forward(self, x):
        x = self.features(x)
        x = self.output_conv(x)
        x = self.sigmoid(x)
        return x
# ┌───────────────────────────────────────────────────────────────────────────┐
# │                        Main Code - Optimization                           │
# └───────────────────────────────────────────────────────────────────────────┘

device = torch.device("cpu")
print(f"device:{device}")

# Define the Model
# model = OurVgg16InstanceNorm2d()
model = OurVgg16InstanceNorm2d24lay()
model.load_state_dict(torch.load(model_path, map_location=device))
model.eval()  # ensure correct evaluation mode
model.to(device)


# Step 1: Prepare input grid
angles_grid = duplicate_pixel_data(angles, x_cm=x_cm, y_cm=y_cm, patch_x=patch_x, patch_y=patch_y, fortran_order=True)

print("\n--- angles_grid ---")
print("Shape:", angles_grid.shape)
print("Min:", angles_grid.min().item(), "Max:", angles_grid.max().item())

# Step 2: Normalize input
normalized_tensor = angles_grid / 180.0


print("\n--- normalized_tensor ---")
print("Min:", normalized_tensor.min().item(), "Max:", normalized_tensor.max().item(), "Shape:", normalized_tensor.shape)

# Comment when Optimizing
# Build and plot
# plt.imshow(angles_grid[0, 0], cmap='plasma', origin='upper')
# plt.title("Input Angles Grid (Fortran Order)")
# plt.colorbar()

# # Get path to Desktop
# desktop = Path.home() / "Desktop"
# output_path = desktop / "angles_grid_input.png"

# #plot
# plt.savefig(str(output_path))
# plt.close()


import time

# Step 3: Model inference
start_time = time.time()
predicted = model(normalized_tensor)
end_time = time.time()

print(f"Inference time: {end_time - start_time:.4f} seconds")

print("\n--- predicted (raw model output) ---")
print("Shape:", predicted.shape)
print("Min:", predicted.min().item(), "Max:", predicted.max().item())


# Comment when Optimizing
# # Save to a .csv file for Excel viewing
# with open("C:/Gal_Msc/tensor_output.csv", "w") as f:
#     batch = predicted[0]
#     for c in range(batch.size(0)):
#         f.write(f"Channel {c}\n")
#         for row in batch[c]:
#             row_str = ",".join(str(x.item()) for x in row)
#             f.write(row_str + "\n")
#         f.write("\n")


# Step 4: Prepare label range tensors
labels_max_tensor = torch.tensor(labels_max, dtype=torch.float32).view(1, -1, 1, 1)
labels_min_tensor = torch.tensor(labels_min, dtype=torch.float32).view(1, -1, 1, 1)


print("\n--- labels_min / labels_max ---")
print("labels_min:", labels_min)
print("labels_max:", labels_max)

# Step 5: Denormalize
denormalized = torch.empty_like(predicted)

for c in range(predicted.shape[1]):
    scale = labels_max[c] - labels_min[c] + 1e-8
    denormalized[:, c] = predicted[:, c] * scale + labels_min[c]
    
    # Debug print
    print(f"Channel {c} - Predicted range: {predicted[:, c].min().item():.4f} to {predicted[:, c].max().item():.4f}")
    print(f"Channel {c} - Denormalized range: {denormalized[:, c].min().item():.4f} to {denormalized[:, c].max().item():.4f}")



print("\n--- denormalized ---")
print("Shape:", denormalized.shape)
print("Min:", denormalized.min().item(), "Max:", denormalized.max().item())
print("Sample [0,0,0,0]:", denormalized[0, 0, 0, 0].item())


# Step 6: Convert to list/tree output
predicted_out_spatial = tensor_to_spatial_tree(denormalized)

# Comment when optimizing

# # Remove batch dimension: [C, H, W]
# denorm = denormalized.detach().squeeze(0)

# # Loop through channels and save each as an image
# for ch in range(denorm.shape[0]):
#     data = denorm[ch].numpy()
#     fig, ax = plt.subplots(figsize=(6, 9))
#     img = ax.imshow(data, cmap='viridis', origin='upper')
#     ax.set_title(f"Predicted Channel {ch}")
#     plt.colorbar(img, ax=ax)
#     plt.tight_layout()

#     output_path = desktop / f"predicted_channel_{ch}.png"
#     plt.savefig(str(output_path))
#     plt.close()
# ---------- end forward_prediction_xyz ----------

# ---- group: Prepare Points / Predicted Pt
item_3 = ListItem(List=forward_prediction_xyz.predicted_out_spatial, Index=0, Wrap=True)
item_4 = ListItem(List=forward_prediction_xyz.predicted_out_spatial, Index=1, Wrap=True)
item_5 = ListItem(List=forward_prediction_xyz.predicted_out_spatial, Index=2, Wrap=True)
pt_5 = ConstructPoint(XCoordinate=item_3, YCoordinate=item_4, ZCoordinate=item_5)

# ---- group: Prepare Points
trim = TrimTree(Tree=pt_5, Depth=1)

# ---- group: Bring targe xy to predicted xy
pdecon = Deconstruct(Point=flip_3)  # -> XComponent, YComponent, ZComponent
pt_6 = ConstructPoint(XCoordinate=pdecon.XComponent, YCoordinate=pdecon.YComponent, ZCoordinate=pdecon.ZComponent)

# ----
# only z / all xyz from forward model!!!
predicted_pt = Point(trim)
target_pt_2 = Point(pt_6)

# ---- group: Bring targe xy to predicted xy (continued)
pdecon_2 = Deconstruct(Point=predicted_pt)  # -> XComponent, YComponent, ZComponent
pt_7 = ConstructPoint(XCoordinate=pdecon_2.XComponent, YCoordinate=pdecon_2.YComponent, ZCoordinate=pdecon.ZComponent)

# ---- group: Orient
plfit = PlaneFit(Points=flatten(predicted_pt))  # -> Plane, Deviation; disabled
plfit_2 = PlaneFit(Points=flatten(target_pt_2))  # -> Plane, Deviation; disabled
deplane = DeconstructPlane(Plane=plfit.Plane)  # -> Origin, XAxis, YAxis, ZAxis; disabled
deplane_2 = DeconstructPlane(Plane=plfit_2.Plane)  # -> Origin, XAxis, YAxis, ZAxis; disabled
multiplication_9 = Multiplication(A=deplane_2.YAxis, B=deplane.YAxis)  # disabled
panel_17 = Panel("0.7")  # disabled
smaller_3 = SmallerThan(FirstNumber=multiplication_9, SecondNumber=panel_17)  # -> SmallerThan, OrEqualTo; disabled
pflip = FlipPlane(Plane=plfit.Plane, ReverseX=False, ReverseY=False, SwapAxes=smaller_3.SmallerThan)  # disabled
flippln = FlipPlane(Plane=pflip, Guide=plfit_2.Plane, FlipX=True, FlipY=True, FlipZ=False)  # -> Flipped, R; disabled
orient_5 = Orient(Geometry=predicted_pt, Source=flippln.Flipped, Target=plfit_2.Plane)  # -> Geometry, Transform; disabled

# ----
panel_18 = Panel(flippln.R)

# ---- group: Checking the Forward in general
number_slider_26 = Slider(0, range=0..100)  # disabled
srf_cp_3 = SurfaceClosestPoint(Point=flatten(predicted_pt), Surface=simulation.L)  # -> Point, UVPoint, Distance; disabled
avr_5 = Average(Input=srf_cp_3.Distance)  # disabled
swatch_10 = ColourSwatch(SwatchColor=RGBA(255, 143, 143, 174))  # disabled
panel_19 = Panel(avr_5)  # disabled
preview_14 = CustomPreview(Geometry=simulation.L, Material=swatch_10)  # disabled

X_2 = UnitX(Factor=number_slider_26)  # disabled
move_6 = Move(Geometry=predicted_pt, Motion=X_2)  # -> Geometry, Transform; disabled
intcrv = Interpolate(Vertices=move_6.Geometry, Degree=3, Periodic=False, KnotStyle=2)  # -> flatten(Curve), Length, Domain; disabled
loft_2 = Loft(Curves=intcrv.Curve, Options={Adjust=False, Closed=False, LoftEnds=0, LoftSimp=0, LoftType=0, Rebuild=10, Refit=0.01})  # disabled
swatch_11 = ColourSwatch(SwatchColor=RGBA(255, 255, 0, 242))  # disabled
preview_15 = CustomPreview(Geometry=loft_2, Material=swatch_11)  # disabled

# ---- group: Calculate weighed chamfer distance
cp = ClosestPoint(Point=orient_5.Geometry, Cloud=flatten(target_pt_2))  # -> ClosestPoint, CPIndex, flatten(Distance); disabled
multiplication_10 = Multiplication(A=cp.Distance, B=data)  # disabled

# ---- group: Calculate weighed chamfer distance / Weighted Average
avr_6 = Average(Input=flatten(multiplication_10))  # disabled
panel_20 = Panel(avr_6)  # disabled

# ---- group: Gene Pool (continued)
fitness = Panel(avr_6)

# ---- group: Calculate weighed chamfer distance / Average
avr_7 = Average(Input=flatten(cp.Distance))  # disabled
panel_21 = Panel(avr_7)  # disabled

# ---- group: Surface Display
intcrv_2 = Interpolate(Vertices=target_pt_2, Degree=3, Periodic=False, KnotStyle=1)  # -> flatten(Curve), Length, Domain; disabled
intcrv_3 = Interpolate(Vertices=orient_5.Geometry, Degree=3, Periodic=False, KnotStyle=1)  # -> flatten(Curve), Length, Domain; disabled
loft_3 = Loft(Curves=intcrv_3.Curve, Options={Adjust=False, Closed=False, LoftEnds=0, LoftSimp=0, LoftType=0, Rebuild=10, Refit=0.01})  # disabled
loft_4 = Loft(Curves=intcrv_2.Curve, Options={Adjust=False, Closed=False, LoftEnds=0, LoftSimp=0, LoftType=0, Rebuild=10, Refit=0.01})  # disabled
swatch_12 = ColourSwatch(SwatchColor=RGBA(255, 115, 129, 57))  # disabled
swatch_13 = ColourSwatch(SwatchColor=RGBA(66, 66, 66, 103))  # disabled
preview_16 = CustomPreview(Geometry=loft_4, Material=swatch_13)  # disabled
preview_17 = CustomPreview(Geometry=loft_3, Material=swatch_12)  # disabled

# ---- group: Previews
gradient_5 = Gradient(
    LowerLimit=number_slider_10,
    UpperLimit=number_slider_9,
    Parameter=data,
    stops=[0: RGB(234, 38, 0), 0.25: RGB(234, 126, 0), 0.5: RGB(254, 244, 84), 0.75: RGB(173, 203, 249), 1: RGB(75, 107, 169)])  # disabled
preview_18 = CustomPreview(Geometry=flatten(predicted_pt), Material=flatten(gradient_5))  # disabled

# ---- group: Get frame
number_slider_27 = Slider(0, range=0..100)  # disabled
branch = TreeBranch(Tree=orient_5.Geometry, Path="{0}", MaintainPaths=True)  # disabled
tstat = TreeStatistics(Tree=orient_5.Geometry)  # -> Paths, Length, Count; disabled
lng_2 = ListLength(List=branch)  # -> flatten(Length); disabled
ptcol = ExtractColumn(Grid=orient_5.Geometry, Col=expr("x-1", lng_2))  # disabled
ptrow = ExtractRow(Grid=orient_5.Geometry, Row=expr("x-1", tstat.Count))  # disabled
ptrow_2 = ExtractRow(Grid=orient_5.Geometry, Row=number_slider_27)  # disabled
ptcol_2 = ExtractColumn(Grid=orient_5.Geometry, Col=number_slider_27)  # disabled
merge_2 = Merge(Data1=ptcol_2, Data2=ptcol, Data3=ptrow_2, Data4=ptrow)  # disabled

# ---- group: Dot display
number_slider_28 = Slider(0.08, range=0.01..1)  # disabled
swatch_14 = ColourSwatch(SwatchColor=RGBA(102, 102, 102, 92))  # disabled
swatch_15 = ColourSwatch(SwatchColor=RGB(176, 55, 85))  # disabled
dots = DotDisplay(Point=orient_5.Geometry, Colour=swatch_15, Size=number_slider_28)  # disabled
dots_2 = DotDisplay(Point=target_pt_2, Colour=swatch_14, Size=number_slider_28)  # disabled

# ---- group: Previews / Predicted
swatch_16 = ColourSwatch(SwatchColor=RGB(255, 242, 0))  # disabled
preview_19 = CustomPreview(Geometry=orient_5.Geometry, Material=swatch_16)  # disabled

# ---- group: Previews / Target
# Previews
swatch_17 = ColourSwatch(SwatchColor=RGB(255, 77, 77))  # disabled
preview_20 = CustomPreview(Geometry=target_pt_2, Material=swatch_17)  # disabled

# ---- group: Optimizer
pt_8 = Point([<point referenced from the Rhino model> x600])
pt_9 = Point([<point referenced from the Rhino model> x600])

# ---- group: Optimizer / Registration that works but isn't differentiable
pc_registration = Python3Script(P=pt_8, Q=pt_9)  # -> out, P_aligned, transform; inputs P: list of Point3d, Q: list of Point3d; disabled
# ---------- pc_registration: Python ----------
# venv: registration
# r: numpy, torch, open3d

import Rhino.Geometry as rg
import open3d as o3d
import numpy as np

def register_pointclouds_gh(P_list, Q_list, distance_threshold=0.01):
    """
    Aligns point cloud P onto Q using:
      1. Center translation
      2. Fast Global Registration
      3. ICP refinement

    Inputs:
        P_list: list of rg.Point3d (source)
        Q_list: list of rg.Point3d (target)
        distance_threshold: ICP max correspondence distance

    Outputs:
        aligned_points: list of rg.Point3d (P aligned to Q)
        final_transformation: 4x4 numpy array
    """

    print("\n--- GH Registration Debug ---")

    # --- 1. Convert GH points to numpy arrays ---
    P_np = np.array([[pt.X, pt.Y, pt.Z] for pt in P_list], dtype=np.float64)
    Q_np = np.array([[pt.X, pt.Y, pt.Z] for pt in Q_list], dtype=np.float64)

    # --- 2. Compute centers ---
    P_center = P_np.mean(axis=0)
    Q_center = Q_np.mean(axis=0)
    print("P center:", P_center, "Q center:", Q_center)

    P_centered = P_np - P_center
    Q_centered = Q_np - Q_center

    # --- 3. Build Open3D point clouds ---
    pcd_P = o3d.geometry.PointCloud()
    pcd_Q = o3d.geometry.PointCloud()
    pcd_P.points = o3d.utility.Vector3dVector(P_centered)
    pcd_Q.points = o3d.utility.Vector3dVector(Q_centered)

    # --- 4. Estimate normals (for registration) ---
    pcd_P.estimate_normals(o3d.geometry.KDTreeSearchParamHybrid(radius=0.1, max_nn=30))
    pcd_Q.estimate_normals(o3d.geometry.KDTreeSearchParamHybrid(radius=0.1, max_nn=30))

    # --- 5. Compute FPFH features for Fast Global Registration ---
    radius_feature = 0.25
    pcd_P_fpfh = o3d.pipelines.registration.compute_fpfh_feature(
        pcd_P, o3d.geometry.KDTreeSearchParamHybrid(radius=radius_feature, max_nn=100)
    )
    pcd_Q_fpfh = o3d.pipelines.registration.compute_fpfh_feature(
        pcd_Q, o3d.geometry.KDTreeSearchParamHybrid(radius=radius_feature, max_nn=100)
    )

    # --- 6. Fast Global Registration ---
    fgr_result = o3d.pipelines.registration.registration_fgr_based_on_feature_matching(
        pcd_P, pcd_Q, pcd_P_fpfh, pcd_Q_fpfh,
        o3d.pipelines.registration.FastGlobalRegistrationOption(
            maximum_correspondence_distance=distance_threshold
        )
    )
    print("FGR transformation:\n", fgr_result.transformation)

    # --- 7. ICP refinement ---
    icp_result = o3d.pipelines.registration.registration_icp(
        pcd_P, pcd_Q, distance_threshold,
        fgr_result.transformation,
        o3d.pipelines.registration.TransformationEstimationPointToPlane()
    )
    print("ICP refined transformation:\n", icp_result.transformation)

    # --- 8. Apply final transformation ---
    P_registered = np.asarray(pcd_P.points)
    P_registered_h = np.hstack((P_registered, np.ones((P_registered.shape[0], 1))))  # (N,4)
    P_transformed = (icp_result.transformation @ P_registered_h.T).T[:, :3]

    # --- 9. Add back Q’s center (since we centered earlier) ---
    P_aligned = P_transformed + Q_center

    # --- 10. Convert back to GH Point3d ---
    aligned_points = [rg.Point3d(float(x), float(y), float(z)) for x, y, z in P_aligned]

    return aligned_points, icp_result.transformation


P_aligned, transform = register_pointclouds_gh(P, Q)
# ---------- end pc_registration ----------

# ---- group: Optimizer (continued)
preview_21 = CustomPreview(Geometry=pc_registration.P_aligned, Material=swatch_9)

# ==== cluster Simulation

# ---- group: Simulation
swatch = ColourSwatch(SwatchColor=RGBA(0, 72, 255, 179))
swatch_2 = ColourSwatch(SwatchColor=RGBA(191, 194, 201, 201))
swatch_3 = ColourSwatch(SwatchColor=RGBA(255, 196, 0, 179))
setgroup = SetGroupProperties(
    Group=["Grasshopper.Kernel.Types.GH_ObjectWrapper", "Grasshopper.Kernel.Types.GH_ObjectWrapper", "Grasshopper.Kernel.Types.GH_ObjectWrapper", "Grasshopper.Kernel.Types.GH_ObjectWrapper", "Grasshopper.Kernel.Types.GH_ObjectWrapper"],
    Color=ColourSwatch(SwatchColor=RGBA(255, 0, 153, 179)))

number_of_columns = Slider(2, range=1..10)
number_of_rows = Slider(4, range=1..10)

# ---- group: Simulation / Shrinkage Amounts
thickness = Slider(0.32, range=0.2..0.5)

# ---- group: Simulation / Basic Shape Inputs
list = ValueList({"Plate": 0, "Ribbon": 1, "Free-Form": 2}, selected="Ribbon")
list_2 = ValueList({"Pixelization": 0, "Adaptive Pattern": 1}, selected="Pixelization")
free_form_curve = Curve(<curve referenced from the Rhino model>)

# ---- group: Simulation
surface_x_size = Slider(20, range=1..100)
surface_y_size = Slider(40, range=1..101)

# ---- group: Simulation / Shrinkage Amounts
fiber_shrinkage_factor_top = Slider(1, range=0..1.1)
matrix_shrinkage_factor_top = Slider(0.976, range=0..1)

fiber_shrinkage_factor_bottom = Slider(1, range=0..1.1)
matrix_shrinkage_factor_bottom = Slider(0.977, range=0..1)

# ----
B = ClusterInput()
num = ClusterInput()
B_2 = ClusterInput()
num_2 = ClusterInput()

# ---- group: Simulation / Simulation Parameters / Web Factors
axialweb = Slider(100, range=0..1000)
bendingweb = Slider(50, range=0..50)

# ---- group: Simulation / Simulation Parameters / Fiber Factors
axialfiber = Slider(40, range=0..50)
bendingfiber = Slider(10, range=0..50)

# ---- group: Simulation / Simulation Parameters / Matrix Factors
axialmatrix = Slider(50, range=0..100)
bendingmatrix = Slider(10, range=0..50)

# ---- group: Simulation / Solver Parameters
pattern_scale = Slider(12, range=4..20)
threshold_factor_10_x = Slider(12, range=8..20)
tolerance_factor_10_x = Slider(6, range=1..20)

# ----
connect_angles = ClusterInput()

# ---- group: Simulation / Matrix Strengh
number_slider = Slider(0, range=0..100)
num_3 = Number(axialmatrix)
subtraction = Subtraction(A=num_3, B=number_slider)
addition = Addition(A=num_3, B=number_slider)
dom = ConstructDomain(DomainStart=addition, DomainEnd=subtraction)

# ---- group: Simulation / Sample Points / accuracy of sample points depends on this
number_slider_2 = Slider(10, range=0..10)

# ----
bottom = Bottom(AddBottom=False, RemoveBottom=False)

# ---- group: Simulation / Match
number_slider_3 = Slider(25, range=0..100)

# ---- group: Move
number_slider_4 = Slider(36, range=0..1000)
number_slider_5 = Slider(38, range=0..1000)

# ----
number_slider_6 = ClusterOutput(number_slider_4)
number_slider_7 = ClusterOutput(number_slider_5)

# ---- group: Simulation
# SELF-MORPHING SIMULATOR
# Insert Fiber Orientation
normal = Number()
distance = Number()
average_dot_product_of_normals = Panel(normal)
mesh = Mesh(<mesh referenced from the Rhino model>)
z_difference = Panel()
swatch_4 = ColourSwatch(SwatchColor=RGB(0, 0, 0))
chamfer_distance = Panel(distance)
num_4 = Number(num)
division = Division(A=num_4, B=B_2)
num_5 = Number(num_2)
division_2 = Division(A=num_5, B=B)
num_6 = Number(division)
num_7 = Number(division_2)
connect_angles_2 = Number(connect_angles)
circular_variance = Python3Script(angles=connect_angles_2)  # -> out, variance; inputs angles: list of Double
# ---------- circular_variance: Python ----------
import math


def circular_variance(angles):
    if not angles:
        return 0  # Handle empty list

    # Map angles to [0, 180) and double them to handle 0° = 180°
    doubled_radians = [math.radians((a % 180) * 2) for a in angles]
    
    # Calculate the sum of unit vectors
    sum_sin = sum(math.sin(r) for r in doubled_radians)
    sum_cos = sum(math.cos(r) for r in doubled_radians)
    
    # Calculate mean resultant length
    R = math.sqrt(sum_sin**2 + sum_cos**2) / len(angles)
    
    # Circular variance (0 = no variation, 1 = max variation)
    variance = 1 - R
    return variance


variance = circular_variance(angles)
# ---------- end circular_variance ----------
sqr = Square(Value=circular_variance.variance)
subtraction_2 = Subtraction(A=Slider(1, range=0..1), B=sqr)
multiplication = Multiplication(A=axialweb, B=subtraction_2)
panel = Panel(multiplication)
subtraction_3 = Subtraction(A=Slider(180, range=0..1000), B=connect_angles_2)
panel_2 = Panel(subtraction_2)
number_slider_8 = Slider(10, range=0..10)
bar_graph = BarGraph(BarColor=RGB(255, 0, 90))
bar_graph_2 = BarGraph(BarColor=RGB(255, 0, 90))
rod = Rod(LengthFactor=1, AngleFactor=1, AxialStrength=10, BendStrength=1)
_1_h = Slider(5000000, range=0..10000000)
_8_m = Slider(1000000, range=0..1000000)
_4_m = Slider(500000, range=0..1000000)
_50_s = Slider(100000, range=0..1000000)
_25_s = Slider(50000, range=0..1000000)
_10_s = Slider(20000, range=0..100000)
_5_s = Slider(10000, range=0..10000)
raise_by_power = RaiseByPower(A=threshold_factor_10_x)
raise_by_power_2 = RaiseByPower(A=tolerance_factor_10_x)

# ---- group: Simulation / Final Fiber Orientation
connect_fiber_orientation_here = Panel(connect_angles_2)
addition_2 = Addition(A=connect_fiber_orientation_here, B=Slider(90, range=0..100))
_90_to_everythin = Panel(addition_2)
num_8 = Number(connect_fiber_orientation_here)
num_9 = Number(_90_to_everythin)

# ---- group: Simulation
multiplication_2 = Multiplication(A=num_6, B=num_7)
genes = GenePool(Decimals=0, Maximum=180, Minimum=0, Value=[0, 90, 90, 90, 90, 90, 90, 90, 90])
pool_controller = GenePoolController(GenePool=genes, Count=multiplication_2, Range=Slider(180, range=0..1000), Decimal=0, Randomness=0.1)

cluster = Cluster(
    srfxsize=num_4,
    base_shape_idx=list,
    srfysize=num_5,
    thickness=thickness,
    pattern_values_top=num_8,
    B=num_6,
    pattern_values_bottom=num_9,
    ex=num_6,
    ey=num_7,
    free_form_crv=free_form_curve,
    B_2=num_7)  # -> B_3, thickness_3, pattern_values_top_3, C, pattern_values_bottom_3
gate_cluster = GateCluster(
    G_6=list_2,
    _0_6=cluster.C,
    G=list_2,
    _0=cluster.pattern_values_top_3,
    G_2=list_2,
    _0_2=cluster.pattern_values_bottom_3,
    G_3=list_2,
    _0_3=num_7,
    G_4=list_2,
    _0_4=num_6,
    G_5=list_2,
    _0_5=cluster.B_3)  # -> s_0_6, s_0, s_0_2, s_0_3, s_0_4, s_0_5
boundry = Curve(cluster.B_3)

# ---- group: Simulation / Moves layer according to thickness
Z = UnitZ(Factor=expr("-x/2", cluster.thickness_3))
move_bottom = Move(Geometry=gate_cluster.s_0_6, Motion=Z)  # -> Geometry, Transform

# ---- group: Simulation / Top Layer Processing / Moves layer according to thickness
Z_2 = UnitZ(Factor=expr("x/2", cluster.thickness_3))
move_top = Move(Geometry=gate_cluster.s_0_6, Motion=Z_2)  # -> Geometry, Transform

# ---- group: Simulation / Sample Points / Sample Points Input
sdivide = DivideSurface(Surface=gate_cluster.s_0_5, UCount=num_4, VCount=num_5)  # -> Points, Normals, Parameters

# ---- group: Simulation / Top Layer Processing
expression = Expression(x=gate_cluster.s_0, Expression="(x+90)%180")
hatchtopfiber = GhPythonScript(
    n_rows=gate_cluster.s_0_3,
    n_cols=gate_cluster.s_0_4,
    boundaries=move_top.Geometry,
    scale=pattern_scale,
    angles=gate_cluster.s_0)  # -> out, boundary_curves, pattern, scale, angles, names, news, geos; inputs boundaries: list of Curve, angles: list
# ---------- hatchtopfiber: Python ----------
__author__ = "Yitzchak Vaknin"
__version__ = "2023.08.31"

import Rhino.Geometry as rg
import Rhino as rh
import rhinoscriptsyntax as rs
import Grasshopper as gh
import scriptcontext as sc
import inspect
import math

#hatche patterns:
hatches = ["Solid","Single Line","Double Line",
"Triple Line","Dashed Line",
"Square Grid","Triangle Grid",
"Plus Grid", "Squares"]


def listToTree(nestedList):
    """Convert a nested python iterable to a datatree."""
    dt = gh.DataTree[object]()
    for i,l in enumerate(nestedList):
        dt.AddRange(l,gh.Kernel.Data.GH_Path(i))
    return dt

def listToTree_2D(nestedList):
    """Convert a nested python iterable to a datatree."""
    dt = gh.DataTree[object]()
    for i,l in enumerate(nestedList):
        for j,val in enumerate(l):
            dt.AddRange(val,gh.Kernel.Data.GH_Path(i))
    return dt

def HatchInfo(rows, cols):
    sc.doc = rh.RhinoDoc.ActiveDoc
    pattern = 1
    hname = hatches[pattern]
    geos = list()
    news = list()
    # iterate on cells:
    for i in range(0, int(rows*cols)):
        local_boundary_curves = list()
        local_geos = list()
        new = rg.Hatch.Create(boundaries[i], pattern, math.radians(angles[i]), scale)
        news.append(new)
        for j, n in enumerate(new):
            g = rg.Hatch.CreateDisplayGeometry(n, rh.DocObjects.HatchPattern.Defaults.Hatch1, 1)
            local_geos.append(g[1])
        geos.append(local_geos)
    geos = listToTree_2D(geos)
    return boundaries, pattern, scale, angles, hname, news, geos

boundary_curves, pattern, scale, angles, names, news, geos = HatchInfo(n_rows, n_cols)
# ---------- end hatchtopfiber ----------
hatchtopmatrix = GhPythonScript(
    n_rows=gate_cluster.s_0_3,
    n_cols=gate_cluster.s_0_4,
    boundaries=move_top.Geometry,
    scale=pattern_scale,
    angles=expression)  # -> out, boundary_curves, pattern, scale, angles, names, news, geos; inputs boundaries: list of Curve, angles: list; same code as hatchtopfiber
merge = Merge(Data1=hatchtopfiber.geos, Data2=hatchtopmatrix.geos)

# ---- group: Simulation (continued)
area = Area(Geometry=hatchtopfiber.boundary_curves)  # -> Area, Centroid

# ---- group: Simulation / Bottom Layer Processing
expression_2 = Expression(x=gate_cluster.s_0_2, Expression="(x+90)%180")
hatchbotfiber = GhPythonScript(
    n_rows=gate_cluster.s_0_3,
    n_cols=gate_cluster.s_0_4,
    boundaries=move_bottom.Geometry,
    scale=pattern_scale,
    angles=expression_2)  # -> out, boundary_curves, pattern, scale, angles, names, news, geos; inputs boundaries: list of Curve, angles: list; same code as hatchtopfiber
hatchbotfiber_2 = GhPythonScript(
    n_rows=gate_cluster.s_0_3,
    n_cols=gate_cluster.s_0_4,
    boundaries=move_bottom.Geometry,
    scale=pattern_scale,
    angles=gate_cluster.s_0_2)  # -> out, boundary_curves, pattern, scale, angles, names, news, geos; inputs boundaries: list of Curve, angles: list; same code as hatchtopfiber
merge_2 = Merge(Data1=hatchbotfiber_2.geos, Data2=hatchbotfiber.geos)

# ---- group: Simulation / Frame Intersection
explode = Explode(Curve=simplify(graft(hatchtopfiber.boundary_curves)), Recursive=True)  # -> flatten(Segments), Vertices
python = GhPythonScript(boundary_lines=explode.Segments)  # -> filtered_boundaries; inputs boundary_lines: list of Curve
# ---------- python: Python ----------
__author__ = "Yitzchak Vaknin"
__version__ = "2023.02.26"

import rhinoscriptsyntax as rs

def filter_duplicate_boundaries(boundary_lines):
    filtered_boundaries = dict()
    for j, frame_line in enumerate(boundary_lines):
        edges = [rs.CurveStartPoint(frame_line), rs.CurveEndPoint(frame_line)]
        sorted_edges = sorted(edges, key=lambda x: (x[0], x[1]))
        frame_key = str(sorted_edges[0]) + "_" + str(sorted_edges[1])
#        print("frame line number {}, {}".format(j, frame_key))
        if frame_key not in filtered_boundaries:
            filtered_boundaries[frame_key] = frame_line
    return list(filtered_boundaries.values())

filtered_boundaries = filter_duplicate_boundaries(boundary_lines)
# ---------- end python ----------
python_2 = GhPythonScript(boundaries=python, pattern_lines=flatten(merge))  # -> intersection_pts; inputs boundaries: list of Curve, pattern_lines: list of Curve
# ---------- python_2: Python ----------
__author__ = "Yitzchak Vaknin"
__version__ = "2023.02.11"

import rhinoscriptsyntax as rs
import Grasshopper as gh

def listToTree(nestedList):
    """Convert a nested python iterable to a datatree."""
    dt = gh.DataTree[object]()
    for i,l in enumerate(nestedList):
        dt.AddRange(l,gh.Kernel.Data.GH_Path(i))
    return dt

def listToTree_2D(nestedList):
    """Convert a nested python iterable to a datatree."""
    dt = gh.DataTree[object]()
    for i,l in enumerate(nestedList):
        for j,val in enumerate(l):
            dt.AddRange(val,gh.Kernel.Data.GH_Path(i))
    return dt

def ccx_old(boundary, pattern_lines):
#    boundary_ctrl_pts = rs.CurvePoints(boundary)
    splited_lines = rs.ExplodeCurves(boundary)
    intersection_pts = list()
    for j, frame_line in enumerate(splited_lines):
        print("frame line number {}, {}".format(j, frame_line))
        local_intersection_pts = list()
        start = rs.CurveStartPoint(frame_line)
        local_intersection_pts.append(start)
        for i, pattern_line in enumerate(pattern_lines):
            print("pattern line number {}, {}".format(i, pattern_line))
            intersection_list = rs.CurveCurveIntersection(frame_line, pattern_line)
            if intersection_list is None:
                print "Selected curves do not intersect."
            else:
                for intersection in intersection_list:
                    local_intersection_pts.append(intersection[1])
                    if intersection[0] == 1:
                        print "Point"
                        print "Intersection point on first curve: ", intersection[1]
                        print "Intersection point on second curve: ", intersection[3]
                        print "First curve parameter: ", intersection[5]
                        print "Second curve parameter: ", intersection[7]
                    else:
                        print "Overlap"
                        print "Intersection start point on first curve: ", intersection[1]
                        print "Intersection end point on first curve: ", intersection[2]
                        print "Intersection start point on second curve: ", intersection[3]
                        print "Intersection end point on second curve: ", intersection[4]
                        print "First curve parameter range: ", intersection[5], " to ", intersection[6]
                        print "Second curve parameter range: ", intersection[7], " to ", intersection[8]
        intersection_pts.append(local_intersection_pts)
    return intersection_pts
#    return intersection_pts, splited_lines

def ccx_test(boundary, pattern_lines):
    intersection_pts = list()
    for j, frame_line in enumerate(boundary):
#        print("frame line number {}, {}".format(j, frame_line))
        local_intersection_pts = list()
        start = rs.CurveStartPoint(frame_line)
        local_intersection_pts.append(start)
        for i, pattern_line in enumerate(pattern_lines):
#            print("pattern line number {}, {}".format(i, pattern_line))
            intersection_list = rs.CurveCurveIntersection(frame_line, pattern_line)
            if intersection_list is None:
                x = 1
#                print "Selected curves do not intersect."
            else:
                for intersection in intersection_list:
                    local_intersection_pts.append(intersection[1])
#                    if intersection[0] == 1:
#                        print "Point"
#                        print "Intersection point on first curve: ", intersection[1]
#                        print "Intersection point on second curve: ", intersection[3]
#                        print "First curve parameter: ", intersection[5]
#                        print "Second curve parameter: ", intersection[7]
#                    else:
#                        print "Overlap"
#                        print "Intersection start point on first curve: ", intersection[1]
#                        print "Intersection end point on first curve: ", intersection[2]
#                        print "Intersection start point on second curve: ", intersection[3]
#                        print "Intersection end point on second curve: ", intersection[4]
#                        print "First curve parameter range: ", intersection[5], " to ", intersection[6]
#                        print "Second curve parameter range: ", intersection[7], " to ", intersection[8]
        intersection_pts.append(local_intersection_pts)
    return intersection_pts

def ccx(boundary_lines, pattern_lines):
    intersection_pts = dict()
    for j, frame_line in enumerate(boundary_lines):
        frame_key = str(rs.CurveStartPoint(frame_line)) + "_" + str(rs.CurveEndPoint(frame_line))
        print("frame line number {}, {}".format(j, frame_key))
        local_intersection_pts = list()
#        start = rs.CurveStartPoint(frame_line)
        local_intersection_pts.append(start)
        for i, pattern_line in enumerate(pattern_lines):
#            print("pattern line number {}, {}".format(i, pattern_line))
            intersection_list = rs.CurveCurveIntersection(frame_line, pattern_line)
            if intersection_list is None:
                print "Selected curves do not intersect."
            else:
                for intersection in intersection_list:
                    local_intersection_pts.append(intersection[1])
                    if intersection[0] == 1:
                        print "Point"
                        print "Intersection point on first curve: ", intersection[1]
                        print "Intersection point on second curve: ", intersection[3]
                        print "First curve parameter: ", intersection[5]
                        print "Second curve parameter: ", intersection[7]
                    else:
                        print "Overlap"
                        print "Intersection start point on first curve: ", intersection[1]
                        print "Intersection end point on first curve: ", intersection[2]
                        print "Intersection start point on second curve: ", intersection[3]
                        print "Intersection end point on second curve: ", intersection[4]
                        print "First curve parameter range: ", intersection[5], " to ", intersection[6]
                        print "Second curve parameter range: ", intersection[7], " to ", intersection[8]
        intersection_pts.append(local_intersection_pts)
    return intersection_pts

intersection_pts = listToTree(ccx_test(boundaries, pattern_lines))
# ---------- end python_2 ----------

# ---- group: Simulation / Zipper
explode_2 = Explode(Curve=simplify(graft(hatchbotfiber_2.boundary_curves)), Recursive=True)  # -> flatten(Segments), Vertices
python_3 = GhPythonScript(boundary_lines=explode_2.Segments)  # -> filtered_boundaries; inputs boundary_lines: list of Curve; same code as python
python_4 = GhPythonScript(boundaries=python_3, pattern_lines=flatten(merge_2))  # -> intersection_pts; inputs boundaries: list of Curve, pattern_lines: list of Curve; same code as python_2

# ---- group: Simulation / Fiber-Matrix Intersection
python_5 = GhPythonScript(fiber_lines=hatchtopfiber.geos, matrix_lines=hatchtopmatrix.geos)  # -> fiber_intersection_pts, matrix_intersection_pts; inputs fiber_lines: list of Curve, matrix_lines: list of Curve
# ---------- python_5: Python ----------
__author__ = "Yitzchak Vaknin"
__version__ = "2023.02.11"

import rhinoscriptsyntax as rs
import Grasshopper as gh
import copy
import ghpythonlib.treehelpers as th

def listToTree(nestedList):
    """Convert a nested python iterable to a datatree."""
    dt = gh.DataTree[object]()
    for i,l in enumerate(nestedList):
        dt.AddRange(l,gh.Kernel.Data.GH_Path(i))
    return dt

def listToTree_2D(nestedList):
    """Convert a nested python iterable to a datatree."""
    dt = gh.DataTree[object]()
    for i,l in enumerate(nestedList):
        print(i)
        for j,val in enumerate(l):
            dt.AddRange(val, gh.Kernel.Data.GH_Path(i, j))
    return dt

def ccx_matrix(fiber_lines, matrix_lines):
    intersection_pts_cycle = list()
    intersection_pts = list()
    for j, matrix_line in enumerate(matrix_lines):
        curve_intersection_pts = list()
        for i, fiber_line in enumerate(fiber_lines):
            intersection_list = rs.CurveCurveIntersection(matrix_line, fiber_line)
            if intersection_list is None:
                x = 1
            else:
                for intersection in intersection_list:
                    curve_intersection_pts.append(intersection[1])
        intersection_pts.append(curve_intersection_pts)
    intersection_pts_cycle.append(copy.copy(intersection_pts))
    for _ in range(len(intersection_pts)):
        intersection_pts.pop(0)
    return intersection_pts_cycle[0]

def ccx_fiber(fiber_lines, matrix_lines):
    intersection_pts_cycle = list()
    intersection_pts = list()
    for i, fiber_line in enumerate(fiber_lines):
        curve_intersection_pts = list()
        for j, matrix_line in enumerate(matrix_lines):
            intersection_list = rs.CurveCurveIntersection(matrix_line, fiber_line)
            if intersection_list is None:
                x = 1
            else:
                for intersection in intersection_list:
                    curve_intersection_pts.append(intersection[1])
        intersection_pts.append(curve_intersection_pts)
    intersection_pts_cycle.append(copy.copy(intersection_pts))
    for _ in range(len(intersection_pts)):
        intersection_pts.pop(0)
    return intersection_pts_cycle[0]
#intersection_pts = th.list_to_tree(ccx_matrix(fiber_lines, matrix_lines)[0])
#th.list_to_tree()
#print(len(intersection_pts[0]))
fiber_intersection_pts = ccx_fiber(fiber_lines, matrix_lines)
matrix_intersection_pts = ccx_matrix(fiber_lines, matrix_lines)
# ---------- end python_5 ----------
graft = GraftTree(Tree=hatchtopmatrix.geos, IncludeEmptyLists=True, IncludeNullItems=True)
c_script = CSharpScript(x=python_5.matrix_intersection_pts)  # -> A
# ---------- c_script: C# ----------
    A = x;
# ---------- end c_script ----------
graft_2 = GraftTree(Tree=hatchtopfiber.geos, IncludeEmptyLists=True, IncludeNullItems=True)
c_script_2 = CSharpScript(x=python_5.fiber_intersection_pts)  # -> A; same code as c_script
crv_cp = CurveClosestPoint(Point=c_script, Curve=graft)  # -> Point, Parameter, Distance
crv_cp_2 = CurveClosestPoint(Point=c_script_2, Curve=graft_2)  # -> Point, Parameter, Distance
shatter = Shatter(Curve=graft, Parameters=crv_cp.Parameter)  # -> simplify(Segments)
shatter_2 = Shatter(Curve=graft_2, Parameters=crv_cp_2.Parameter)  # -> simplify(Segments)

# ---- group: Simulation / Bottom Layer Processing / Fiber-Matrix Intersection
python_6 = GhPythonScript(fiber_lines=hatchbotfiber_2.geos, matrix_lines=hatchbotfiber.geos)  # -> fiber_intersection_pts, matrix_intersection_pts; inputs fiber_lines: list of Curve, matrix_lines: list of Curve; same code as python_5
graft_3 = GraftTree(Tree=hatchbotfiber.geos, IncludeEmptyLists=True, IncludeNullItems=True)
c_script_3 = CSharpScript(x=python_6.matrix_intersection_pts)  # -> A; same code as c_script
graft_4 = GraftTree(Tree=hatchbotfiber_2.geos, IncludeEmptyLists=True, IncludeNullItems=True)
c_script_4 = CSharpScript(x=python_6.fiber_intersection_pts)  # -> A; same code as c_script
crv_cp_3 = CurveClosestPoint(Point=c_script_3, Curve=graft_3)  # -> Point, Parameter, Distance
crv_cp_4 = CurveClosestPoint(Point=c_script_4, Curve=graft_4)  # -> Point, Parameter, Distance
shatter_3 = Shatter(Curve=graft_3, Parameters=crv_cp_3.Parameter)  # -> simplify(Segments)
shatter_4 = Shatter(Curve=graft_4, Parameters=crv_cp_4.Parameter)  # -> simplify(Segments)

# ---- group: Simulation / Middle Mesh
removeduplicatepoints = GhPythonScript(x=flatten(python_2))  # -> pts; inputs x: list of Point3d
# ---------- removeduplicatepoints: Python ----------
__author__ = "Yitzchak Vaknin"
__version__ = "2023.09.10"

import rhinoscriptsyntax as rs

def filter_duplicate_points(pts_lst):
    filtered_pts = dict()
    for i, pt in enumerate(pts_lst):
        pt_key = str(pt[0]) + "_" + str(pt[1]) + "_" + str(pt[2])
        if pt_key not in filtered_pts:
            filtered_pts[pt_key] = pt
    return list(filtered_pts.values())

pts = filter_duplicate_points(x)
# ---------- end removeduplicatepoints ----------
removeduplicatepoints_2 = GhPythonScript(x=flatten(python_4))  # -> pts; inputs x: list of Point3d; same code as removeduplicatepoints
pt = Point(flatten([removeduplicatepoints, crv_cp_2.Point]))
pt_2 = Point(flatten([removeduplicatepoints_2, crv_cp_4.Point]))
cps = ClosestPoints(Point=flatten(pt_2), Cloud=flatten(pt), Count=Slider(10, range=0..10))  # -> simplify(ClosestPoint), CPIndex, Distance
ln = Line(StartPoint=simplify(graft(pt_2)), EndPoint=cps.ClosestPoint)  # -> flatten(Line)

# ---- group: Simulation / Sample Points
srf_cp = SurfaceClosestPoint(Point=sdivide.Points, Surface=cluster.B_3)  # -> Point, UVPoint, Distance
pt_3 = Point([pt, pt_2])
cps_2 = ClosestPoints(Point=flatten(sdivide.Points), Cloud=flatten(pt_3), Count=number_slider_2)  # -> simplify(ClosestPoint), CPIndex, Distance
ln_2 = Line(StartPoint=simplify(graft(sdivide.Points)), EndPoint=cps_2.ClosestPoint)
rodbotzipper = Rod(
    Polyline=ln_2,
    LengthFactor=1,
    AngleFactor=1,
    AxialStrength=Slider(0.001, range=0..1),
    BendStrength=Slider(0.001, range=0..50))

# ---- group: Simulation / Floor
scale = Scale(Geometry=gate_cluster.s_0_5, Center=Point(0, 0, 0), Factor=Slider(2, range=-10..10))  # -> Geometry, Transform
dom_2 = ConstructDomain(DomainStart=Slider(-10, range=-10..10), DomainEnd=Slider(0, range=-10..10))
merge_3 = Merge(Data1=crv_cp_2.Point, Data2=crv_cp.Point, Data3=cps.ClosestPoint, Data4=pt, Data5=crv_cp_4.Point, Data6=crv_cp_3.Point)  # -> flatten(Result)
boxrec = BoxRectangle(Rectangle=scale.Geometry, Height=dom_2)
duppt = RemoveDuplicatePts(Points=merge_3, Tolerance=0.01)
box_corners = BoxCorners(Box=boxrec)  # -> CornerA, CornerB, CornerC, CornerD, CornerE, CornerF, CornerG, CornerH
merge_4 = Merge(Data1=box_corners.CornerE, Data2=box_corners.CornerF, Data3=box_corners.CornerG, Data4=box_corners.CornerH)
anchor = Anchor(Point=merge_4, Strength=Slider(100000000, range=0..100000000))
spc = SolidPointCollide(Points=duppt, Solid=boxrec, Interior=False, Unidirectional=True, Strength=1)

# ---- group: Simulation / Gravity
Z_3 = UnitZ(Factor=Slider(0.0001, range=0..1))
rev = Reverse(Vector=Z_3)
load = Load(Point=duppt, ForceVector=rev, Weighting=1)

# ---- group: Simulation / Web Strengh
number_slider_9 = Slider(100, range=0..200)
num_10 = Number(axialweb)
subtraction_4 = Subtraction(A=num_10, B=number_slider_9)
addition_3 = Addition(A=num_10, B=number_slider_9)

# ---- group: Simulation (continued)
clip_1 = Python3Script(d1=subtraction_4, d2=addition_3)  # -> out, d1, d2; inputs d1: Int32, d2: Int32
# ---------- clip_1: Python ----------
"""Grasshopper Script"""
a = "Hello Python 3 in Grasshopper!"
print(a)
if d1 < 1:
    d1 = 1
    print("d1 = 1")

if d2 < 1:
    d2 = 1
    print("d2 = 1")
# ---------- end clip_1 ----------
mat_top = Curve(shatter)
mat_bot = Curve(shatter_3)

# ---- group: Simulation / Web Strengh (continued)
dom_3 = ConstructDomain(DomainStart=clip_1.d1, DomainEnd=clip_1.d2)

# ---- group: Simulation / Mat Strength
map_shrinkage = MapShrinkage(curve=mat_top, curve_2=boundry, target=dom)

# ---- group: Simulation / Mat Strengh
map_shrinkage_2 = MapShrinkage(curve=mat_bot, curve_2=boundry, target=dom)

# ---- group: Simulation / Web Strengh
map_shrinkage_3 = MapShrinkage(curve=ln, curve_2=boundry, target=dom_3)

# ---- group: Simulation (continued)
bar_graph_3 = BarGraph(map_shrinkage, BarColor=RGB(255, 0, 90))

# ---- group: Simulation / Domains
number_slider_10 = Slider(0, range=0..0.1)
num_11 = Number(matrix_shrinkage_factor_bottom)
num_12 = Number(matrix_shrinkage_factor_top)
subtraction_5 = Subtraction(A=num_12, B=number_slider_10)
addition_4 = Addition(A=num_12, B=number_slider_10)
dom_4 = ConstructDomain(DomainStart=subtraction_5, DomainEnd=addition_4)

subtraction_6 = Subtraction(A=num_11, B=number_slider_10)
addition_5 = Addition(A=num_11, B=number_slider_10)

dom_5 = ConstructDomain(DomainStart=subtraction_6, DomainEnd=addition_5)

# ---- group: Simulation / Mat Shrinkage
map_shrinkage_4 = MapShrinkage(curve=mat_top, curve_2=boundry, target=dom_4)

map_shrinkage_5 = MapShrinkage(curve=mat_bot, curve_2=boundry, target=dom_5)

# ---- group: Simulation / Top
rodtopfiber = Rod(
    Polyline=shatter_2,
    LengthFactor=fiber_shrinkage_factor_top,
    AngleFactor=1,
    AxialStrength=axialfiber,
    BendStrength=bendingfiber)
rodtopmatrix = Rod(Polyline=shatter, LengthFactor=map_shrinkage_4, AngleFactor=1, AxialStrength=map_shrinkage, BendStrength=bendingmatrix)

# ---- group: Simulation / Bottom
rodbottomfiber = Rod(
    Polyline=shatter_4,
    LengthFactor=fiber_shrinkage_factor_bottom,
    AngleFactor=1,
    AxialStrength=axialfiber,
    BendStrength=bendingfiber)
rodbottommatrix = Rod(
    Polyline=shatter_3,
    LengthFactor=map_shrinkage_5,
    AngleFactor=1,
    AxialStrength=map_shrinkage_2,
    BendStrength=bendingmatrix)

# ---- group: Simulation
rodtoptobot = Rod(Polyline=ln, LengthFactor=1, AngleFactor=1, AxialStrength=map_shrinkage_3, BendStrength=bendingweb)
entwine = Entwine(
    Branch00=rodtopfiber,
    Branch01=rodtopmatrix,
    Branch02=rodtoptobot,
    Branch03=rodbottomfiber,
    Branch04=rodbottommatrix,
    Branch05=rodbotzipper,
    Branch06=graft(spc),
    Branch07=anchor,
    Branch08=load,
    FlattenInputs=True)

# ----
solver = Solver(GoalObjects=entwine, Reset=Button(), Threshold=raise_by_power, Tolerance=raise_by_power_2, On=Toggle(False))  # -> I, V, O

# ---- group: Simulation (continued)
panel_3 = Panel(map_shrinkage_5)
zombiesolver = ZombieSolver(GoalObjects=entwine, Threshold=raise_by_power, Tolerance=raise_by_power_2, MaxIterations=_8_m)  # -> I, V, O
geo = Geometry(zombiesolver.O)
panel_4 = Panel(zombiesolver.I)
unflatten = UnflattenTree(Tree=geo, Guide=entwine)
bang = ExplodeTree(Data=unflatten)  # -> Branch0, Branch1, Branch2, Branch3, Branch4, Branch5, Branch6, Branch7, Branch8
data = Data(bang.Branch1)
data_2 = Data(bang.Branch0)
data_3 = Data(bang.Branch2)
data_4 = Data(bang.Branch3)
data_5 = Data(bang.Branch4)

# ---- group: Simulation / Get Sample Points
unflatten_2 = UnflattenTree(Tree=bang.Branch5, Guide=rodbotzipper)
trim = TrimTree(Tree=unflatten_2, Depth=1)
item = ListItem(List=trim, Index=0, Wrap=True)  # -> flatten(Item)
end = EndPoints(Curve=item)  # -> Start, End
sample_points = Data(end.Start)

# ---- group: Simulation / Mesh total z difference
pdecon = Deconstruct(Point=sample_points)  # -> XComponent, YComponent, ZComponent
sort = SortList(Keys=pdecon.ZComponent)  # -> Keys, ValuesA
lng = ListLength(List=sort.Keys)
item_2 = ListItem(List=sort.Keys, Index=expr("x-1", lng), Wrap=True)
item_3 = ListItem(List=sort.Keys, Index=0, Wrap=True)
subtraction_7 = Subtraction(A=item_2, B=item_3)
panel_5 = Panel(subtraction_7)

# ---- group: Simulation (continued)
height = Panel(panel_5)
division_3 = Division(A=z_difference, B=subtraction_7)
percantage_of_z = Panel(division_3)

# ----
curvepreview = CurvePreview(Curve=data_2, Width=Slider(2, range=1..4), Color=ColourSwatch(SwatchColor=RGB(0, 0, 0)), Mode=0, TopMost=False)

# ---- group: Simulation / Lofted Surface
partition = PartitionList(List=flatten(sample_points), Size=expr("x+1", num_5))
intcrv = Interpolate(Vertices=partition, Degree=4, Periodic=False, KnotStyle=1)  # -> flatten(Curve), Length, Domain
loft = Loft(Curves=intcrv.Curve, Options={Adjust=False, Closed=False, LoftEnds=0, LoftSimp=0, LoftType=0, Rebuild=10, Refit=0.01})

# ----
dots = DotDisplay(Point=sample_points, Colour=ColourSwatch(SwatchColor=RGB(94, 46, 64)), Size=Slider(0.082, range=0..5))
L = ClusterOutput(loft)
preview = CustomPreview(Geometry=loft, Material=ColourSwatch(SwatchColor=RGBA(217, 132, 155, 22)))

# ==== cluster RaiseByPower
A = ClusterInput()
multiplication = Multiplication(A=A, B=-1)
pow = Power(A=Slider(10, range=0..10), B=multiplication)
R = ClusterOutput(pow)

# ==== cluster GateCluster
G = ClusterInput()
_0 = ClusterInput()
_1 = ClusterInput()
G_2 = ClusterInput()
_0_2 = ClusterInput()
_1_2 = ClusterInput()
G_3 = ClusterInput()
_0_3 = ClusterInput()
_1_3 = ClusterInput()
G_4 = ClusterInput()
_0_4 = ClusterInput()
G_5 = ClusterInput()
_0_5 = ClusterInput()
_1_4 = ClusterInput()
G_6 = ClusterInput()
_0_6 = ClusterInput()
_1_5 = ClusterInput()

# ---- group: Adaptive or Pixelization Gate / Shape's Dimensions
num = Number(1)
filter = StreamFilter(Gate=G_3, Stream0=_0_3, Stream1=_1_3)
filter_2 = StreamFilter(Gate=G_4, Stream0=_0_4, Stream1=num)

# ---- group: Adaptive or Pixelization Gate
filter_top = StreamFilter(Gate=G, Stream0=flatten(_0), Stream1=_1)
filter_bot = StreamFilter(Gate=G_2, Stream0=flatten(_0_2), Stream1=_1_2)
filter_srf = StreamFilter(Gate=G_5, Stream0=_0_5, Stream1=_1_4)
filter_patch_curves = StreamFilter(Gate=G_6, Stream0=_0_6, Stream1=_1_5)

# ----
s_0 = ClusterOutput(filter_top)
s_0_2 = ClusterOutput(filter_bot)
s_0_3 = ClusterOutput(filter)
s_0_4 = ClusterOutput(filter_2)
s_0_5 = ClusterOutput(filter_srf)
s_0_6 = ClusterOutput(filter_patch_curves)

# ==== cluster Cluster
free_form_crv = ClusterInput()
base_shape_idx = ClusterInput()
B = ClusterInput()
B_2 = ClusterInput()
ex = ClusterInput()
ey = ClusterInput()
srfxsize = ClusterInput()
thickness = ClusterInput()
srfysize = ClusterInput()
pattern_values_top = ClusterInput()
pattern_values_bottom = ClusterInput()

# ---- group: Cluster Inputs
srfxsize_2 = Number(srfxsize)
thickness_2 = Number(thickness)
srfysize_2 = Number(srfysize)
pattern_values_top_2 = Number(simplify(graft(pattern_values_top)))
pattern_values_bottom_2 = Number(simplify(graft(pattern_values_bottom)))

# ---- group: Build Mesh
dom = ConstructDomain(DomainStart=expr("-x/2", srfxsize_2), DomainEnd=expr("x/2", srfxsize_2))
dom_2 = ConstructDomain(DomainStart=expr("-x/2", srfysize_2), DomainEnd=expr("x/2", flatten(srfysize_2)))
boundary = BoundarySurfaces(FreeFormCrv=free_form_crv)
cir = Circle(Plane=PlaneXY(0, 0, 0), Radius=expr("x/2", srfxsize_2))
planesrf1 = PlaneSurface(Plane=PlaneXY(0, 0, 0), XSize=dom, YSize=dom_2)
boundary_2 = BoundarySurfaces(Edges=cir)
filter = StreamFilter(BaseShapeIdx=base_shape_idx, Stream0=boundary_2, Stream1=planesrf1, Stream2=boundary)
srf = Surface(filter)
Z = UnitZ(Thickness=thickness_2)
gate = StreamGate(Stream=srf, Gate=0)  # -> Target0, Target1

# ---- group: Grid
brec = BoundingRectangle(Geometry=srf, Plane=PlaneXY(0, 0, 0), Axis=0, Slide=0, Union=True)  # -> Bounding, DimensionX, DimensionY
pt = ConstructPoint(XCoordinate=expr("-x/2", brec.DimensionX), YCoordinate=expr("-x/2", brec.DimensionY), ZCoordinate=0)
division = Division(A=brec.DimensionX, B=B)
division_2 = Division(A=brec.DimensionY, B=B_2)
recgrid = Rectangular(Plane=pt, SizeX=division, SizeY=division_2, ExtentX=ex, ExtentY=ey)  # -> flatten(Cells), flatten(Points)

# ----
B_3 = ClusterOutput(brec.Bounding)
C = ClusterOutput(recgrid.Cells)
thickness_3 = ClusterOutput(thickness_2)
pattern_values_top_3 = ClusterOutput(pattern_values_top_2)
pattern_values_bottom_3 = ClusterOutput(pattern_values_bottom_2)

# ==== cluster MapShrinkage

# ---- group: To boundry
curve = ClusterInput()
curve_middle = CurveMiddle(Curve=curve)
curve_2 = ClusterInput()
curve_closest_point = CurveClosestPoint(Point=curve_middle, Curve=curve_2)  # -> Point, Parameter, Distance
multiplication = Multiplication(A=curve_closest_point.Distance, B=curve_closest_point.Distance)
sqrt = SquareRoot(Value=curve_closest_point.Distance)

# ---- group: To corners
control_polygon = ControlPolygon(Curve=curve_2)  # -> Polygon, Points
closest_point = ClosestPoint(Point=curve_middle, Cloud=control_polygon.Points)  # -> ClosestPoint, CPIndex, Distance
multiplication_2 = Multiplication(A=closest_point.Distance, B=closest_point.Distance)
number = Number(multiplication_2)

# ----
number_2 = Number(curve_closest_point.Distance)
subtraction = Subtraction(A=number_2)
text_tag = TextTag(Location=curve_middle, Text=subtraction)
bounds = Bounds(Numbers=flatten(subtraction))
target = ClusterInput()
remap_numbers = RemapNumbers(Value=subtraction, Source=bounds, Target=target)  # -> Mapped, Clipped
mapped = ClusterOutput(remap_numbers.Mapped)
